# Grasshopper definition SecondModelWindAndSun.gh (Grasshopper 1.0.7)

unit_z = UnitZ(Factor=1)
point = Point("184,60")
circle_cnr = CircleCNR(Center=point, Normal=Vector(0, 0, 1), Radius="45.486418415")
move = Move(Geometry=point, Motion=unit_z)  # -> Geometry, Transform

# ----
# Numbre Polygon edges
number_slider = Slider(6, range=3..30)

_7_45 = Panel("2705.002025")
area_of_outer_polygon = Panel("6500")
panel = Panel("3010.636078")

# ----
# Offset of inner circle. Effects:
# - Building's width
# - Footprint (7.5 = appx 3000m²; if angle 30 and A of outside 6500)
# - diametre of courtyard
width_of_building_2 = Panel("7.5")

area = Area(Geometry=circle_cnr)  # -> Area, Centroid
axis = Line(StartPoint=point, EndPoint=move.Geometry)
panel_2 = Panel("2640.602726")  # "30,45"
panel_3 = Panel("2939.60748")  # "30,30"
expression = Expression(x=area_of_outer_polygon, y=number_slider, Expression="((x*2)/(y*sin(2*π/y)))^0.5")
panel_4 = Panel(area.Area)

# ----
# Fillet edges
number_slider_2 = Slider(0, range=0..20)

# ----
# Angle of Opening
number_slider_3 = Slider(30, range=15..45)

# ----
# Rotate Opening by
# polyline corner and segment
number_slider_4 = Slider(6, range=0..50)
multiplication = Multiplication(A=number_slider, B=2)
division = Division(A="360", B=multiplication)
multiplication_2 = Multiplication(A=division, B=number_slider_4)
counter_clockwise_angle = Panel(multiplication_2)

radius = Panel(expression)
number_slider_5 = Slider(10, range=10..13)

# ----
# Change Ratio
number_slider_6 = Slider(1.3, range=1..2)

polygon = Polygon(Plane=point, Radius=expression, Segments=number_slider, FilletRadius=number_slider_2)  # -> Polygon, Length
multiplication_3 = Multiplication(A=number_slider, B=2)
xy_plane = XYPlane(Origin=point)
division_2 = Division(A="360", B=multiplication_3)
ghpython_script = PythonScript(slider=number_slider_3)  # -> out, a
# ---------- ghpython_script: Python ----------
info = []

for input in ghenv.Component.Params.Input:
    for source in input.Sources:
        print input.Name
        if input.Name == "slider":
            a = str(source.InstanceGuid)
# ---------- end ghpython_script ----------
ghpython_script_2 = PythonScript(slider=number_slider)  # -> out, a; same code as ghpython_script
division_3 = Division(A=number_slider_5, B=10)
ghpython_script_3 = PythonScript(slider=number_slider_5)  # -> out, a; same code as ghpython_script
division_4 = Division(A=1, B=division_3)
ratio = Panel(division_3)
sliderid_angleopening = Panel(ghpython_script.a)
subtraction = Subtraction(A="90", B=division_2)

# ----
# Rotate Opening
_10_steps = Slider(-3, range=-18..18)

ghpython_script_4 = PythonScript(slider=_10_steps)  # -> out, a; same code as ghpython_script
sliderid_orientationopening = Panel(ghpython_script_4.a)
sliderid_polygonedges = Panel(ghpython_script_2.a)
sliderid_ratio = Panel(ghpython_script_3.a)
unit_y = UnitY(Factor="60")
rotate_axis = RotateAxis(Geometry=polygon.Polygon, Angle=degrees(subtraction), Axis=axis)  # -> Geometry, Transform
scale_nu = ScaleNU(Geometry=rotate_axis.Geometry, Plane=xy_plane, ScaleX=division_4, ScaleY=division_3, ScaleZ=1)  # -> Geometry, Transform
multiplication_4 = Multiplication(A=_10_steps, B=10)
move_2 = Move(Geometry=point, Motion=unit_y)  # -> Geometry, Transform
orientaiton_of_opening = Panel(multiplication_4)
area_2 = Area(Geometry=scale_nu.Geometry)  # -> Area, Centroid
offset_curve = OffsetCurve(Curve=scale_nu.Geometry, Distance=expr("x*-1", width_of_building_2), Plane=PlaneXY(0, 0, 0), Corners=1)
offset_curve_2 = OffsetCurve(Curve=scale_nu.Geometry, Distance=expr("x*-2", width_of_building_2), Plane=PlaneXY(0, 0, 0), Corners=1)
line = Line(StartPoint=point, EndPoint=move_2.Geometry)
area_of_outer_polygon_2 = Panel(area_2.Area)
unit_z_2 = UnitZ(Factor=1)
yz_plane = YZPlane(Origin=point)
unit_z_3 = UnitZ(Factor=1)
unit_z_4 = UnitZ(Factor=1)

# ----
# Division of Round Edge
number_slider_7 = Slider(4, range=2..6)

# ----
# Width of Building
multiplication_5 = Multiplication(A=width_of_building_2, B=2)
width_of_building = Panel(multiplication_5)

total_volume = Panel("200000")

# ----
# Creating Custom Window
panel_5 = Panel("Glazing")
panel_6 = Panel("High Performative Glazing")
epwindowmat = Honeybee_EnergyPlusWindowMaterial(name=panel_5, U_Value="0.8", SHGC="0.7", VT="0.7")  # -> EPMaterial; plug-in component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
epwindowmat_2 = Honeybee_EnergyPlusWindowMaterial(name=panel_6, U_Value="0.2", SHGC="0.3", VT="0.7")  # -> EPMaterial; plug-in component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
epconstruction = Honeybee_EnergyPlusConstruction(name=panel_5, layer_1=epwindowmat)  # -> EPConstruction; plug-in component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
epconstruction_2 = Honeybee_EnergyPlusConstruction(name=panel_6, layer_1=epwindowmat_2)  # -> EPConstruction; plug-in component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

# ----
# Creating Custom Wall
panel_7 = Panel("Insulation")
epopaquemat = Honeybee_EnergyPlusOpaqueMaterial(name=panel_7, thickness="0.15", conductivity="0.035", density="100", specificHeat="830")  # -> EPMaterial; plug-in component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
epopaquemat_2 = Honeybee_EnergyPlusOpaqueMaterial(name="Concrete", thickness="0.36", conductivity="2", density="2400", specificHeat="950")  # -> EPMaterial; plug-in component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
epconstruction_3 = Honeybee_EnergyPlusConstruction(name="ExtWall", layer_1=epopaquemat, layer_2=epopaquemat_2)  # -> EPConstruction; plug-in component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

# ----
# Rotate Building
_10_steps_2 = Slider(5, range=0..18)
multiplication_6 = Multiplication(A=_10_steps_2, B=10)

ghpython_script_5 = PythonScript(slider=_10_steps_2)  # -> out, a; same code as ghpython_script
sliderid_orientationbuilding = Panel(ghpython_script_5.a)
multiplication_7 = Multiplication(A=multiplication_6, B=-1)
addition = Addition(A=multiplication_4, B=multiplication_7)
rotate_axis_2 = RotateAxis(Geometry=line, Angle=degrees([multiplication_2, addition]), Axis=axis)  # -> Geometry, Transform
extrude = Extrude(Base=rotate_axis_2.Geometry, Direction=unit_z_2)
rotate_axis_3 = RotateAxis(Geometry=rotate_axis_2.Geometry, Angle=expr("x*-1", degrees(number_slider_3)), Axis=axis)  # -> Geometry, Transform
curve_curve = CurveCurve(CurveA=rotate_axis_3.Geometry, CurveB=offset_curve)  # -> Points, ParamsA, ParamsB
rotate_axis_4 = RotateAxis(Geometry=rotate_axis_2.Geometry, Angle=degrees(number_slider_3), Axis=axis)  # -> Geometry, Transform
curve_curve_2 = CurveCurve(CurveA=rotate_axis_4.Geometry, CurveB=offset_curve)  # -> Points, ParamsA, ParamsB
curve_closest_point = CurveClosestPoint(Point=curve_curve.Points, Curve=offset_curve)  # -> Point, Parameter, Distance
curve_closest_point_2 = CurveClosestPoint(Point=curve_curve_2.Points, Curve=offset_curve)  # -> Point, Parameter, Distance
curve_closest_point_3 = CurveClosestPoint(Point=curve_curve.Points, Curve=offset_curve_2)  # -> Point, Parameter, Distance
curve_closest_point_4 = CurveClosestPoint(Point=curve_curve.Points, Curve=scale_nu.Geometry)  # -> Point, Parameter, Distance
curve_curve_3 = CurveCurve(CurveA=rotate_axis_3.Geometry, CurveB=offset_curve_2)  # -> Points, ParamsA, ParamsB
curve_closest_point_5 = CurveClosestPoint(Point=curve_curve_3.Points, Curve=offset_curve_2)  # -> Point, Parameter, Distance
curve_curve_4 = CurveCurve(CurveA=rotate_axis_4.Geometry, CurveB=offset_curve_2)  # -> Points, ParamsA, ParamsB
curve_closest_point_6 = CurveClosestPoint(Point=curve_curve_4.Points, Curve=offset_curve_2)  # -> Point, Parameter, Distance
shatter = Shatter(Curve=offset_curve_2, Parameters=[curve_closest_point_6.Parameter, curve_closest_point_5.Parameter])
curve_curve_5 = CurveCurve(CurveA=rotate_axis_3.Geometry, CurveB=scale_nu.Geometry)  # -> Points, ParamsA, ParamsB
curve_closest_point_7 = CurveClosestPoint(Point=curve_curve_5.Points, Curve=scale_nu.Geometry)  # -> Point, Parameter, Distance
curve_curve_6 = CurveCurve(CurveA=rotate_axis_4.Geometry, CurveB=scale_nu.Geometry)  # -> Points, ParamsA, ParamsB
curve_closest_point_8 = CurveClosestPoint(Point=curve_curve_6.Points, Curve=scale_nu.Geometry)  # -> Point, Parameter, Distance
shatter_2 = Shatter(Curve=scale_nu.Geometry, Parameters=[curve_closest_point_8.Parameter, curve_closest_point_7.Parameter])
mirror = Mirror(Geometry=curve_closest_point_3.Point, Plane=extrude)  # -> Geometry, Transform
mirror_2 = Mirror(Geometry=curve_closest_point_4.Point, Plane=extrude)  # -> Geometry, Transform
length = Length(Curve=shatter)
length_2 = Length(Curve=shatter_2)
curve_closest_point_9 = CurveClosestPoint(Point=mirror.Geometry, Curve=offset_curve_2)  # -> Point, Parameter, Distance
curve_closest_point_10 = CurveClosestPoint(Point=mirror_2.Geometry, Curve=scale_nu.Geometry)  # -> Point, Parameter, Distance
sort_list = SortList(Keys=length, ValuesValuesA=shatter)  # -> Keys, ValuesValuesA
shatter_3 = Shatter(Curve=offset_curve, Parameters=[curve_closest_point.Parameter, curve_closest_point_2.Parameter])
sort_list_2 = SortList(Keys=length_2, ValuesValuesA=shatter_2)  # -> Keys, ValuesValuesA
shatter_4 = Shatter(Curve=offset_curve_2, Parameters=[curve_closest_point_3.Parameter, curve_closest_point_9.Parameter])
shatter_5 = Shatter(Curve=scale_nu.Geometry, Parameters=[curve_closest_point_4.Parameter, curve_closest_point_10.Parameter])
length_3 = Length(Curve=shatter_3)
list_item = ListItem(List=sort_list.ValuesValuesA, Index="1", Wrap=True)
line_2 = Line(StartPoint=curve_curve_5.Points, EndPoint=curve_curve_3.Points)
line_3 = Line(StartPoint=curve_curve_6.Points, EndPoint=curve_curve_4.Points)
list_item_2 = ListItem(List=sort_list_2.ValuesValuesA, Index="1", Wrap=True)
length_4 = Length(Curve=shatter_4)
length_5 = Length(Curve=shatter_5)
sort_list_3 = SortList(Keys=length_3, ValuesValuesA=shatter_3)  # -> Keys, ValuesValuesA
sort_list_4 = SortList(Keys=length_4, ValuesValuesA=shatter_4)  # -> Keys, ValuesValuesA
join_curves = JoinCurves(Curves=[line_3, line_2, list_item_2, list_item], Preserve=False)  # -> flatten(Curves)
sort_list_5 = SortList(Keys=length_5, ValuesValuesA=shatter_5)  # -> Keys, ValuesValuesA
list_item_3 = ListItem(List=sort_list_3.ValuesValuesA, Index="1", Wrap=True)
flip_curve = FlipCurve(Curve=list_item_3)  # -> Curve, Flag
join_curves_2 = JoinCurves(Curves=join_curves, Preserve=False)
line_4 = Line(StartPoint=curve_closest_point_4.Point, EndPoint=curve_closest_point_3.Point)
line_5 = Line(StartPoint=curve_closest_point_10.Point, EndPoint=curve_closest_point_9.Point)
list_item_4 = ListItem(List=sort_list_4.ValuesValuesA, Index="1", Wrap=True)
list_item_5 = ListItem(List=sort_list_5.ValuesValuesA, Index="1", Wrap=True)
evaluate_length = EvaluateLength(Curve=flip_curve.Curve, Length=width_of_building_2, Normalized=False)  # -> Point, Tangent, Parameter
evaluate_length_2 = EvaluateLength(Curve=list_item_3, Length=width_of_building_2, Normalized=False)  # -> Point, Tangent, Parameter
move_3 = Move(Geometry=evaluate_length_2.Point, Motion=unit_z_3)  # -> Geometry, Transform
move_4 = Move(Geometry=evaluate_length.Point, Motion=unit_z_4)  # -> Geometry, Transform
join_curves_3 = JoinCurves(Curves=[list_item_5, list_item_4, line_4, line_5], Preserve=False)  # -> flatten(Curves)
curve_closest_point_11 = CurveClosestPoint(Point=evaluate_length_2.Point, Curve=scale_nu.Geometry)  # -> Point, Parameter, Distance
curve_closest_point_12 = CurveClosestPoint(Point=curve_closest_point_11.Point, Curve=scale_nu.Geometry)  # -> Point, Parameter, Distance
curve_closest_point_13 = CurveClosestPoint(Point=evaluate_length.Point, Curve=scale_nu.Geometry)  # -> Point, Parameter, Distance
curve_closest_point_14 = CurveClosestPoint(Point=curve_closest_point_13.Point, Curve=scale_nu.Geometry)  # -> Point, Parameter, Distance
line_6 = Line(StartPoint=evaluate_length_2.Point, EndPoint=move_3.Geometry)
shatter_6 = Shatter(Curve=scale_nu.Geometry, Parameters=[curve_closest_point_12.Parameter, curve_closest_point_14.Parameter])
xy_plane_2 = XYPlane(Origin=evaluate_length_2.Point)
line_7 = Line(StartPoint=evaluate_length.Point, EndPoint=move_4.Geometry)
xy_plane_3 = XYPlane(Origin=evaluate_length.Point)
join_curves_4 = JoinCurves(Curves=join_curves_3, Preserve=False)
circle = Circle(Plane=xy_plane_2, Radius=width_of_building_2)
rotate_axis_5 = RotateAxis(Geometry=curve_closest_point_11.Point, Angle=expr("x*-1", 1.570796327), Axis=line_6)  # -> Geometry, Transform
circle_2 = Circle(Plane=xy_plane_3, Radius=width_of_building_2)
length_6 = Length(Curve=shatter_6)
rotate_axis_6 = RotateAxis(Geometry=curve_closest_point_13.Point, Angle=1.570796327, Axis=line_7)  # -> Geometry, Transform
curve_proximity = CurveProximity(CurveA=circle, CurveB=offset_curve_2)  # -> PointA, PointB, Distance
curve_proximity_2 = CurveProximity(CurveA=circle_2, CurveB=offset_curve_2)  # -> PointA, PointB, Distance
sort_list_6 = SortList(Keys=length_6, ValuesValuesA=shatter_6)  # -> Keys, ValuesValuesA
point_2 = Point(curve_proximity.PointB)
curve_closest_point_15 = CurveClosestPoint(Point=point_2, Curve=offset_curve_2)  # -> Point, Parameter, Distance
point_3 = Point(curve_proximity_2.PointB)
curve_closest_point_16 = CurveClosestPoint(Point=point_3, Curve=offset_curve_2)  # -> Point, Parameter, Distance
shatter_7 = Shatter(Curve=offset_curve_2, Parameters=[curve_closest_point_15.Parameter, curve_closest_point_16.Parameter])
length_7 = Length(Curve=shatter_7)
sort_list_7 = SortList(Keys=length_7, ValuesValuesA=shatter_7)  # -> Keys, ValuesValuesA
arc_3pt = Arc3Pt(PointA=curve_closest_point_11.Point, PointB=rotate_axis_5.Geometry, PointC=point_2)  # -> Arc, Plane, Radius
list_item_6 = ListItem(List=sort_list_7.ValuesValuesA, Index="1", Wrap=True)
list_item_7 = ListItem(List=sort_list_6.ValuesValuesA, Index="1", Wrap=True)
control_points = ControlPoints(Curve=list_item_7)  # -> Points, Weights, Knots
arc_3pt_2 = Arc3Pt(PointA=curve_closest_point_13.Point, PointB=rotate_axis_6.Geometry, PointC=point_3)  # -> Arc, Plane, Radius
control_points_2 = ControlPoints(Curve=list_item_6)  # -> Points, Weights, Knots
polyline = PolyLine(Vertices=control_points.Points, Closed=True)
shatter_8 = Shatter(Curve=list_item_6, Parameters=control_points_2.Knots)
join_curves_5 = JoinCurves(Curves=[list_item_7, list_item_6, arc_3pt.Arc, arc_3pt_2.Arc], Preserve=False)  # -> flatten(Curves)
polyline_2 = PolyLine(Vertices=control_points_2.Points, Closed=False)

# ----
# Good for catching wind
curve = Curve(join_curves_2)
area_3 = Area(Geometry=curve)  # -> Area, Centroid
unit_x = UnitX(Factor="150")
area_of_footprint = Panel(area_3.Area)
move_5 = Move(Geometry=curve, Motion=unit_x)  # -> Geometry, Transform
surface = Surface(move_5.Geometry)

# ----
# Perpendicular ends
panel_8 = Panel("300")
curve_2 = Curve(join_curves_4)
unit_x_2 = UnitX(Factor=panel_8)
area_4 = Area(Geometry=curve_2)  # -> Area, Centroid
move_6 = Move(Geometry=curve_2, Motion=unit_x_2)  # -> Geometry, Transform
area_of_footprint_2 = Panel(area_4.Area)
surface_2 = Surface(move_6.Geometry)

list_item_8 = ListItem(List=shatter_8, Index=0, Wrap=True)
list_item_9 = ListItem(List=shatter_8, Index="1", Wrap=True)

# ----
# Round Ends
join_curves_6 = JoinCurves(Curves=join_curves_5, Preserve=False)
area_5 = Area(Geometry=join_curves_6)  # -> Area, Centroid
surface_3 = Surface(join_curves_6)
area_of_footprint_3 = Panel(area_5.Area)

divide_curve = DivideCurve(Curve=arc_3pt.Arc, Count=number_slider_7, Kinks=False)  # -> Points, Tangents, Parameters
divide_curve_2 = DivideCurve(Curve=arc_3pt_2.Arc, Count=number_slider_7, Kinks=False)  # -> Points, Tangents, Parameters
polyline_3 = PolyLine(Vertices=divide_curve_2.Points, Closed=False)
polyline_4 = PolyLine(Vertices=divide_curve.Points, Closed=False)
division_5 = Division(A=total_volume, B=area_of_footprint_3)
division_6 = Division(A=total_volume, B=area_of_footprint_2)
unit_z_5 = UnitZ(Factor=division_5)
division_7 = Division(A=total_volume, B=area_of_footprint)
unit_z_6 = UnitZ(Factor=division_6)
unit_z_7 = UnitZ(Factor=division_7)
extrude_2 = Extrude(Base=surface_3, Direction=unit_z_5)
extrude_3 = Extrude(Base=surface_2, Direction=unit_z_6)
extrude_4 = Extrude(Base=surface, Direction=unit_z_7)
panel_9 = Panel(multiplication_6)
join_curves_7 = JoinCurves(Curves=[list_item_7, list_item_6, polyline_4, polyline_3], Preserve=False)  # -> flatten(Curves)
join_curves_8 = JoinCurves(Curves=join_curves_7, Preserve=False)
surface_4 = Surface(join_curves_8)
ladybug = Ladybug_Ladybug()  # -> out; plug-in component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
honeybee = Honeybee_Honeybee()  # -> out; plug-in component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
rotate_axis_7 = RotateAxis(Geometry=surface_4, Angle=degrees(multiplication_6), Axis=axis)  # -> Geometry, Transform
area_6 = Area(Geometry=rotate_axis_7.Geometry)  # -> Area, Centroid
footprint = Panel(area_6.Area)
division_8 = Division(A=total_volume, B=footprint)
height = Panel(division_8)
unit_z_8 = UnitZ(Factor=division_8)
extrude_5 = Extrude(Base=list_item_7, Direction=unit_z_8)
extrude_6 = Extrude(Base=polyline_4, Direction=unit_z_8)
extrude_7 = Extrude(Base=polyline_3, Direction=unit_z_8)
extrude_8 = Extrude(Base=list_item_6, Direction=unit_z_8)
move_7 = Move(Geometry=surface_4, Motion=unit_z_8)  # -> Geometry, Transform
rotate_axis_8 = RotateAxis(Geometry=extrude_5, Angle=degrees(multiplication_6), Axis=axis)  # -> Geometry, Transform
rotate_axis_9 = RotateAxis(Geometry=extrude_6, Angle=degrees(multiplication_6), Axis=axis)  # -> Geometry, Transform
rotate_axis_10 = RotateAxis(Geometry=extrude_8, Angle=degrees(multiplication_6), Axis=axis)  # -> Geometry, Transform
rotate_axis_11 = RotateAxis(Geometry=extrude_7, Angle=degrees(multiplication_6), Axis=axis)  # -> Geometry, Transform
rotate_axis_12 = RotateAxis(Geometry=move_7.Geometry, Angle=degrees(multiplication_6), Axis=axis)  # -> Geometry, Transform

# ----
# Honeybee Zone
panel_10 = Panel("Outward Wall")
createhbsrfs = Honeybee_createHBSrfs(geometry=rotate_axis_8.Geometry, srfName=panel_10, srfType="0", EPConstruction=epconstruction_3)  # -> out, simplify(HBSurface); plug-in component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
createhbsrfs_2 = Honeybee_createHBSrfs(geometry=rotate_axis_10.Geometry, srfName="Inward Wall", srfType="0", EPConstruction=epconstruction_3)  # -> out, simplify(HBSurface); plug-in component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
createhbsrfs_3 = Honeybee_createHBSrfs(
    geometry=[rotate_axis_9.Geometry, rotate_axis_11.Geometry],
    srfName="Round Edge Wall",
    srfType="0",
    EPConstruction=epconstruction_3)  # -> out, simplify(HBSurface); plug-in component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
createhbsrfs_4 = Honeybee_createHBSrfs(geometry=rotate_axis_7.Geometry, srfName="Floor", srfType="2.75", EPConstruction=epconstruction_3)  # -> out, simplify(HBSurface); plug-in component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
number_slider_8 = Slider(10, range=0..10)
createhbsrfs_5 = Honeybee_createHBSrfs(geometry=rotate_axis_12.Geometry, srfName="Roof", srfType="1", EPConstruction=epconstruction_3)  # -> out, simplify(HBSurface); plug-in component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
glazingcreator = Honeybee_GlazingBasedOnRatio(HBObjects=createhbsrfs_2.HBSurface, glzRatio="0.95", EPConstructions=epconstruction, runIt=Toggle(True))  # -> out, HBObjWGLZ; plug-in component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
glazingcreator_2 = Honeybee_GlazingBasedOnRatio(
    HBObjects=createhbsrfs.HBSurface,
    glzRatio="0.15",
    windowHeight="15",
    sillHeight="15",
    splitGlzVertDist="20",
    EPConstructions=epconstruction,
    runIt=Toggle(True))  # -> out, HBObjWGLZ; plug-in component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
glazingcreator_3 = Honeybee_GlazingBasedOnRatio(
    HBObjects=createhbsrfs_3.HBSurface,
    glzRatio="0.5",
    sillHeight=number_slider_8,
    splitGlzVertDist=number_slider_8,
    EPConstructions=epconstruction,
    runIt=Toggle(True))  # -> out, HBObjWGLZ; plug-in component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
relay = Relay([glazingcreator.HBObjWGLZ, glazingcreator_2.HBObjWGLZ, glazingcreator_3.HBObjWGLZ, createhbsrfs_4.HBSurface, createhbsrfs_5.HBSurface])
createhbzones = Honeybee_createHBZones(name="envelope", HBSurfaces=flatten(relay), isConditioned=True)  # -> out, HBZone; plug-in component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
split2floors = Honeybee_SplitBuildingMass2Floors(bldgMasses=createhbzones.HBZone, bldgsFlr2FlrHeights="@4", runIt=Toggle(False))  # -> out, flatten(splitBldgFloors); plug-in component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

# ----
# Compactness and GlztoWall Ratio
area_7 = Area(Geometry=[rotate_axis_11.Geometry, rotate_axis_9.Geometry])  # -> Area, Centroid
area_8 = Area(Geometry=[rotate_axis_10.Geometry, rotate_axis_8.Geometry, rotate_axis_9.Geometry, rotate_axis_11.Geometry, rotate_axis_7.Geometry, rotate_axis_12.Geometry])  # -> flatten(Area), Centroid
area_9 = Area(Geometry=rotate_axis_8.Geometry)  # -> Area, Centroid
area_10 = Area(Geometry=rotate_axis_10.Geometry)  # -> Area, Centroid
mass_addition = MassAddition(Input=area_7.Area)  # -> Result, PartialResults
mass_addition_2 = MassAddition(Input=area_8.Area)  # -> Result, PartialResults
volume = Volume(Geometry=createhbzones.HBZone)  # -> Volume, Centroid
multiplication_8 = Multiplication(A=area_9.Area, B="0.15")
multiplication_9 = Multiplication(A=area_10.Area, B="0.95")
multiplication_10 = Multiplication(A=mass_addition.Result, B="0.5")
division_9 = Division(A=mass_addition_2.Result, B=volume.Volume)
mass_addition_3 = MassAddition(Input=flatten([multiplication_10, multiplication_8, multiplication_9]))  # -> Result, PartialResults
division_10 = Division(A=mass_addition_3.Result, B=mass_addition_2.Result)
compactness = Panel(division_9)
glazing_to_wall_ratio = Panel(division_10)

offset_curve_3 = OffsetCurve(Curve=list_item_7, Distance=Slider(3, range=0..10), Plane=PlaneXY(0, 0, 0), Corners=1)
addition_2 = Addition(A=division_5, B="5")
unit_z_9 = UnitZ(Factor=addition_2)
extrude_9 = Extrude(Base=offset_curve_3, Direction=unit_z_8)
move_8 = Move(Geometry=scale_nu.Geometry, Motion=unit_z_9)  # -> Geometry, Transform
rotate_axis_13 = RotateAxis(Geometry=extrude_9, Angle=degrees(multiplication_6), Axis=axis)  # -> Geometry, Transform
surface_5 = Surface(move_8.Geometry)
rotate_axis_14 = RotateAxis(Geometry=surface_5, Angle=degrees(multiplication_6), Axis=axis)  # -> Geometry, Transform

# ----
# Thresholds
panel_11 = Panel("26")
setepzonethresholds = Honeybee_SetEnergyPlusZoneThresholds(HBZones=createhbzones.HBZone, coolingSetPt=panel_11, heatingSetPt="20", daylightIllumSetPt="300")  # -> out, HBZones; plug-in component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

# ----
# Display
decomposebytype = Honeybee_DecomposeBasedOnType(HBZone=setepzonethresholds.HBZones)  # -> walls, interiorWalls, airWalls, windows, interiorWindows, skylights, roofs, ceilings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; plug-in component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
custom_preview = CustomPreview(Geometry=decomposebytype.walls, Material=ColourSwatch(SwatchColor=RGB(255, 248, 176)))
custom_preview_2 = CustomPreview(Geometry=decomposebytype.windows, Material=ColourSwatch(SwatchColor=RGBA(74, 225, 255, 132)))
custom_preview_3 = CustomPreview(Geometry=decomposebytype.roofs, Material=ColourSwatch(SwatchColor=RGB(255, 163, 140)))
custom_preview_4 = CustomPreview(Geometry=decomposebytype.exposedFloors, Material=ColourSwatch(SwatchColor=RGB(8, 86, 255)))

hb_epcontextsrf = HoneybeeEPContextSurfaces(shdSurfaces=flatten([rotate_axis_13.Geometry, rotate_axis_14.Geometry]))  # -> HBContext; inputs shdSurfaces: list of Brep, justBoundingBox: Boolean
# ---------- hb_epcontextsrf: Python ----------
"""
prepare shading/context geometries

    Args:
        northVectorOrRotation: A vector that shows North or a number that shows
                               the rotation of the North from the Y axis
        bldgMasses: List of closed Breps as thermal zones.
    Returns:
        report: ...
        thermalZones: Thermal zone's geometries for visualiza
"""

ghenv.Component.Name = 'Honeybee EP context Surfaces'
ghenv.Component.NickName = 'HB_EPContextSrf'
ghenv.Component.Message = 'VER 0.0.66\nJUL_07_2020'
ghenv.Component.IconDisplayMode = ghenv.Component.IconDisplayMode.application
ghenv.Component.Category = "HB-Legacy"
ghenv.Component.SubCategory = "10 | Energy | Energy"
#compatibleHBVersion = VER 0.0.57\nNOV_04_2016
#compatibleLBVersion = VER 0.0.59\nFEB_01_2015
ghenv.Component.AdditionalHelpFromDocStrings = "2"

import rhinoscriptsyntax as rs
import Rhino as rc
import scriptcontext as sc
import os
import System
import Grasshopper.Kernel as gh
import uuid

tolerance = sc.doc.ModelAbsoluteTolerance
import math


def main(shdSurfaces, EPTransSchedule, meshingSettings, justBoundingBox):
    
    # import the classes
    if sc.sticky.has_key('honeybee_release'):

        try:
            if not sc.sticky['honeybee_release'].isCompatible(ghenv.Component): return -1
            if sc.sticky['honeybee_release'].isInputMissing(ghenv.Component): return -1
        except:
            warning = "You need a newer version of Honeybee to use this compoent." + \
            " Use updateHoneybee component to update userObjects.\n" + \
            "If you have already updated userObjects drag Honeybee_Honeybee component " + \
            "into canvas and try again."
            w = gh.GH_RuntimeMessageLevel.Warning
            ghenv.Component.AddRuntimeMessage(w, warning)
            return -1
        
        # don't customize this part
        hb_EPSrf = sc.sticky["honeybee_EPSurface"]
        hb_EPSHDSurface = sc.sticky["honeybee_EPShdSurface"]
        hb_RADMaterialAUX = sc.sticky["honeybee_RADMaterialAUX"]
        hb_EPObjectsAux = sc.sticky["honeybee_EPObjectsAUX"]()
        HBScheduleList = sc.sticky["honeybee_ScheduleLib"].keys()

        ########################################################################
        #----------------------------------------------------------------------#
        shdBreps = []
        # create bounding box of shading geometries
        if justBoundingBox:
            for brep in shdSurfaces:
                if brep.Faces.Count>1 or not brep.Faces[0].IsPlanar(sc.doc.ModelAbsoluteTolerance):
                    shdBreps.append(brep.GetBoundingBox(True).ToBrep())
                else:
                    shdBreps.append(brep)
        else:
            shdBreps = shdSurfaces
        
        shadingClasses = []
        shadingMeshPreview = []
        
        if meshingSettings == None:
            mp = rc.Geometry.MeshingParameters.Minimal
            mp.SimplePlanes = True
        else:
            mp = meshingSettings
        
        def getRadMaterialName(radMaterial):
            nameStr = radMaterial.split(" ")[2]
            name =  nameStr.split("\n")[0]
            return name
        
        for brepCount, brep in enumerate(shdBreps):
            if brep != None:
                isPlanar = True
                # check planarity
                for face in brep.Faces:
                    if not face.IsPlanar(tolerance):
                        isPlanar = False
                        break
                
                shadingBreps = []
                if not isPlanar:
                    meshArray = rc.Geometry.Mesh.CreateFromBrep(brep, mp)
                    for mesh in meshArray:
                        for meshFace in range(mesh.Faces.Count):
                            vertices = list(mesh.Faces.GetFaceVertices(meshFace))[1:]
                            vertices = vertices + [sc.doc.ModelAbsoluteTolerance]
                            # create the brep from mesh
                            shdBrep = rc.Geometry.Brep.CreateFromCornerPoints(*vertices)
                            shadingBreps.append(shdBrep)
                else:
                    for face in brep.Faces:
                        shadingBreps.append(face.DuplicateFace(False))
                
                for faceCount, shdBrep in enumerate(shadingBreps):
                        thisShading = hb_EPSHDSurface(shdBrep, 1000*brepCount + faceCount, 'shdSrf_' + `brepCount` + '_' + `faceCount` + "_" + str(uuid.uuid4()))
                        
                        # add transmittance schedule if any
                        if EPTransSchedule!=None:
                            schedule= EPTransSchedule.upper()
                            if schedule!=None and not schedule.lower().endswith(".csv") and schedule not in HBScheduleList:
                                msg = "Cannot find " + schedule + " in Honeybee schedule library."
                                print msg
                                ghenv.Component.AddRuntimeMessage(gh.GH_RuntimeMessageLevel.Warning, msg)
                                return -1
                            elif schedule!=None and schedule.lower().endswith(".csv"):
                                # check if csv file is existed
                                if not os.path.isfile(schedule):
                                    msg = "Cannot find the shchedule file: " + schedule
                                    print msg
                                    ghenv.Component.AddRuntimeMessage(gh.GH_RuntimeMessageLevel.Warning, msg)
                                    return -1
                            
                            thisShading.TransmittanceSCH = schedule
                        
                        # add the Rad Material if any
                        if RADMaterial!=None:
                            # if it is just the name of the material make sure it is already defined
                            if len(RADMaterial.split(" ")) == 1:
                                # if the material is not in the library add it to the library
                                if not hb_RADMaterialAUX.isMatrialExistInLibrary(RADMaterial):
                                    warningMsg = "Can't find " + RADMaterial + " in RAD Material Library.\n" + \
                                                "Add the material to the library and try again."
                                    ghenv.Component.AddRuntimeMessage(gh.GH_RuntimeMessageLevel.Warning, warningMsg)
                                    return
                                
                                try:
                                    thisShading.setRADMaterial(RADMaterial)
                                except Exception, e:
                                    print e
                                    warningMsg = "You are using an old version of Honeybee_Honeybee! Update your files and try again."
                                    print warningMsg
                                    ghenv.Component.AddRuntimeMessage(gh.GH_RuntimeMessageLevel.Warning, warningMsg)
                                    return
                                
                                addedToLib = True
                            else:
                                
                                # try to add the material to the library
                                addedToLib, thisShading.RadMaterial = hb_RADMaterialAUX.analyseRadMaterials(RADMaterial, True)
                                
                            if addedToLib==False:
                                warningMsg = "Failed to add " + RADMaterial + " to the Library."
                                ghenv.Component.AddRuntimeMessage(gh.GH_RuntimeMessageLevel.Warning, warningMsg)
                                return
                        
                        # add shading to the list
                        shadingClasses.append(thisShading)
                
        # add to the hive
        hb_hive = sc.sticky["honeybee_Hive"]()
        HBContext  = hb_hive.addToHoneybeeHive(shadingClasses, ghenv.Component)
        return HBContext
        ################################################################################################
    else:
        print "You should first let Honeybee to fly..."
        w = gh.GH_RuntimeMessageLevel.Warning
        ghenv.Component.AddRuntimeMessage(w, "You should first let Honeybee to fly...")
        return -1
        

if _shdSurfaces and _shdSurfaces[0]!=None:
    # add cleaning function
    result= main(_shdSurfaces, EPTransSchedule_, meshingSettings_, justBoundingBox_)
    
    if result != -1: HBContext = result
# ---------- end hb_epcontextsrf ----------
boolean_toggle = BooleanToggle(True)
epoutput = Honeybee_GenerateEPOutput(
    zoneEnergyUse=boolean_toggle,
    zoneGainsAndLosses=boolean_toggle,
    zoneComfortMetrics=boolean_toggle,
    surfaceTempAnalysis=boolean_toggle,
    surfaceEnergyAnalysis=boolean_toggle)  # -> out, flatten(simulationOutputs); plug-in component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
exporttoopenstudio = Honeybee_ExportToOpenStudio(
    epwWeatherFile="C:\Users\PewPe\Downloads\HotArid.epw",
    HBZones=flatten(setepzonethresholds.HBZones),
    HBContext=flatten(hb_epcontextsrf),
    simulationOutputs=flatten(epoutput.simulationOutputs),
    writeOSM=Toggle(True),
    runSimulation=Toggle(True))  # -> out, osmFileAddress, idfFileAddress, resultFileAddress, eioFileAddress, rddFileAddress, htmlReport, studyFolder, model; plug-in component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
readepresult = Honeybee_ReadEPResult(resultFileAddress=exporttoopenstudio.resultFileAddress)  # -> totalThermalLoad, thermalLoadBalance, cooling, heating, electricLight, electricEquip, port, port_2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; plug-in component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
readepsrfresult = Honeybee_ReadEPSurfaceResult(resultFileAddress=exporttoopenstudio.resultFileAddress)  # -> surfaceIndoorTemp, surfaceOutdoorTemp, surfaceEnergyFlow, opaqueEnergyFlow, glazEnergyFlow, port, port_2, port_3, port_4; plug-in component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
strnum = Ladybug_SeparateData(inputList=flatten(readepresult.totalSolarGain))  # -> numbers, strings; plug-in component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
strnum_2 = Ladybug_SeparateData(inputList=flatten(readepresult.heating))  # -> numbers, strings; plug-in component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
strnum_3 = Ladybug_SeparateData(inputList=flatten(readepresult.cooling))  # -> numbers, strings; plug-in component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
energybalance = Honeybee_ConstructEnergyBalance(
    HBZones=flatten(setepzonethresholds.HBZones),
    cooling=readepresult.cooling,
    heating=readepresult.heating,
    electricLight=readepresult.electricLight,
    electricEquip=readepresult.electricEquip,
    peopleGains=readepresult.peopleGains,
    totalSolarGain=readepresult.totalSolarGain,
    infiltrationEnergy=readepresult.infiltrationEnergy,
    mechVentilationEnergy=readepresult.mechVentilationEnergy,
    natVentEnergy=readepresult.port_3,
    surfaceEnergyFlow=readepsrfresult.surfaceEnergyFlow)  # -> out, port, flrNormEnergyBal, flrNormBalWStorage, port_2, modelEnergyBalance, energyBalWithStorage; disabled; plug-in component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
mass_addition_4 = MassAddition(Input=flatten(strnum.numbers))  # -> Result, PartialResults
mass_addition_5 = MassAddition(Input=flatten(strnum_3.numbers))  # -> Result, PartialResults
mass_addition_6 = MassAddition(Input=flatten(strnum_2.numbers))  # -> Result, PartialResults
cooling_load_kwh = Panel(mass_addition_5.Result)
heating_load_kwh = Panel(mass_addition_6.Result)
panel_12 = Panel(mass_addition_4.Result)
boolean_toggle_2 = BooleanToggle(True)  # disabled
panel_13 = Panel("19")  # disabled
division_11 = Division(A=cooling_load_kwh, B=volume.Volume)
division_12 = Division(A=panel_12, B=volume.Volume)
division_13 = Division(A=heating_load_kwh, B=volume.Volume)
selectandaveragedata = Ladybug_AverageData(annualHourlyData=energybalance.energyBalWithStorage, totalOrAverage=boolean_toggle_2)  # -> readMe, selHourlyData, totaledDaily, totaledMonthly, totMonthlyPerHour, totMonthlyMinPerHour, totMonthlyMaxPerHour; disabled; plug-in component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
gradientlibrary = Ladybug_GradientLibrary(gradIndex=panel_13)  # -> customColors; disabled; plug-in component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
panel_14 = Panel("330000")  # disabled
solargain_kwh_m3 = Panel(division_12)
legendpar = Ladybug_LegendParameters(highBound=panel_14, customColors=flatten(gradientlibrary))  # -> legendPar; disabled; plug-in component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
cooling_load_kwh_m3 = Panel(division_11)
heating_load_kwh_m3 = Panel(division_13)
panel_15 = Panel("connected, all glazed (gvl=0.3, uval=0,2), with shading on top (r=25) and full side")  # disabled
boolean_toggle_3 = BooleanToggle(True)  # disabled
panel_16 = Panel("600,100")  # disabled
barchart = Ladybug_MonthlyBarChart(
    inputData=flatten(selectandaveragedata.totaledMonthly),
    stackValues=boolean_toggle_3,
    altTitle=panel_15,
    basePoint=panel_16,
    legendPar=legendpar)  # -> out, dataMesh, dataCurves, dataCrvColors, graphAxes, graphLabels, title, titleBasePt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; disabled; plug-in component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

# ----
# Python Script
ghpython_script_6 = GhPythonScript(
    PolygonEdges=number_slider,
    BuildingRatio=ratio,
    AngleofOpening=number_slider_3,
    OrientationofOpening=orientaiton_of_opening,
    OrientationofBuilding=panel_9,
    Compactness=compactness,
    GlztoWallRatio=glazing_to_wall_ratio,
    Height=height,
    Footprint=footprint,
    CoolingLoad=cooling_load_kwh_m3,
    HeatingLoad=heating_load_kwh_m3,
    SolarGain=solargain_kwh_m3)  # -> out, a
# ---------- ghpython_script_6: Python ----------
__author__ = "Desktop"
__version__ = "2020.10.28"

import rhinoscriptsyntax as rs

f = open('C:\Users\PewPe\OneDrive\Skrivebord\WindAndSun.txt', 'a')
string = str(PolygonEdges) + ',' + BuildingRatio + ',' + str(AngleofOpening) + ',' + OrientationofOpening + ',' + OrientationofBuilding + ',' + Compactness + ',' + GlztoWallRatio + ',' + Height + ',' + Footprint + ',' + CoolingLoad + ',' + HeatingLoad + ',' + SolarGain + '\n'
f.write(string)
f.close()
a = string
# ---------- end ghpython_script_6 ----------

panel_17 = Panel(ghpython_script_6.a)
