# Dynamo graph facade_system_v2.dyn (Dynamo 2.6.1.8786)

input_facade = CodeBlock()
# ---------- input_facade.designscript (15 lines) ----------
pt1 = Point.ByCoordinates(0,0,0);
pt2 = Point.ByCoordinates(0,0,20);
pt3 = Point.ByCoordinates(0,0,30);

pts = [pt1,pt3];

cir1 = Circle.ByCenterPointRadius(pt1,15);
cir2 = Circle.ByCenterPointRadius(pt2,10);
cir3 = Circle.ByCenterPointRadius(pt3,15);

cirs = [cir1,cir2,cir3];

srf = Surface.ByLoft(cirs);

numberOfFloors = 6;
# ----------------------------------------
create_floors_python = Python(IN[0]=input_facade.pts, IN[1]=input_facade.srf, IN[2]=input_facade.numberOfFloors)
# ---------- create_floors_python.python (49 lines) ----------
# Load the Python Standard and DesignScript Libraries
import sys
import clr
clr.AddReference('ProtoGeometry')
from Autodesk.DesignScript.Geometry import *

def createZcoordFloors(ptB, ptT, nFloors):
	dist = Point.DistanceTo(ptB,ptT)
	span = dist/nFloors
	i =0
	zcord=ptB.Z
	zcords = []
	while i< 1000:
		if zcord > ptT.Z:
			break
		else:
			zcords.append(zcord)
		i += 1
		zcord = zcord + span
	return [zcords,span]

# The inputs to this node will be stored as a list in the IN variables.
dataEnteringNode = IN

pts = IN[0]
srf = IN[1]
nFl = IN[2]
# Place your code below this line
zcords = createZcoordFloors(pts[0],pts[1], nFl)
floorH = zcords[1]

plns = []
crvs = []
srfs = []
sols = []
for z in zcords[0]:
	vecZ = Vector.ByCoordinates(0,0,1)
	ori = Point.ByCoordinates(0,0,z)
	pln = Plane.ByOriginNormal(ori, vecZ)
	plns.append(pln)
	crv = Plane.Intersect(pln,srf)[0]
	crvs.append(crv)
	nsrf = Surface.ByPatch(crv)
	srfs.append(nsrf)
	sol = Curve.ExtrudeAsSolid(crv,0.2)
	sols.append(sol)

# Assign your output to the OUT variable.
OUT = [plns,crvs,srfs, sols]
# ----------------------------------------
code_block = CodeBlock { xspan = 5; yspan = 5; spans = [xspan,yspan]; }
create_columns_python = Python(IN[0]=create_floors_python, IN[1]=code_block.spans)
# ---------- create_columns_python.python (77 lines) ----------
# Load the Python Standard and DesignScript Libraries
import sys
import clr
clr.AddReference('ProtoGeometry')
from Autodesk.DesignScript.Geometry import *


def createDomain(min,max,step):
	domain = [0]
	i=0
	number1 = 0
	number2 = 0
	while i < 100:
		i +=1
		number1 = number1 + step
		number2 = number2 - step
		if number1 <= max:
			domain.append(number1)
		
		if number2 >= min:
			domain.append(number2)
		
	domain.sort()
	return domain
	
def comparePtsOnFloors(pt1,pt2):
	res = 0
	if pt1.X == pt2.X and pt1.Y == pt2.Y:
		res = 1
	return res
# The inputs to this node will be stored as a list in the IN variables.
dataEnteringNode = IN

pls = IN[0][0]
edges = IN[0][1]
floors = IN[0][2]
spanX = IN[1][0]
spanY = IN[1][1]
# Place your code below this line

pts = []


for i in range(pls.Count):
	pl = pls[i]
	floor = floors[i]
	bob = BoundingBox.ByGeometry(floor)
	pb1 = bob.MinPoint
	pb2 = bob.MaxPoint
	domainX = createDomain(pb1.X, pb2.X, spanX)
	domainY = createDomain(pb1.Y, pb2.Y, spanY)
	ipts = []
	for ix in domainX:
		for jy in domainY:
			pt = Point.ByCoordinates(ix,jy, pl.Origin.Z)
			dist = Surface.DistanceTo(floor,pt)
			if dist == 0:
				ipts.append(pt)
	pts.append(ipts)
scolumns =[]	
columns = []
for j in range(pls.Count -1):
	ptsThisFloor = pts[j]
	ptsNextFloor = pts[j+1]
	icolumns = []
	for pt1 in ptsThisFloor:
		for pt2 in ptsNextFloor:
			if comparePtsOnFloors(pt1,pt2) == 1:
				col = Line.ByStartPointEndPoint(pt1,pt2)
				sec = Circle.ByCenterPointRadius(pt1,0.1)
				vec = Vector.ByTwoPoints(pt1,pt2)
				sol = Curve.ExtrudeAsSolid(sec,vec)
				scolumns.append(sol)
				icolumns.Add(col)
	columns.append(icolumns)
# Assign your output to the OUT variable.
OUT = [pts,columns,scolumns]
# ----------------------------------------
code_block_2 = CodeBlock(a=create_floors_python, b=create_columns_python)
# ---------- code_block_2.designscript (8 lines) ----------
//planes =a[0];
//curves =a[1];
//surfaces =a[2];
solidsFloors =a[3];

//columnPoints = b[0];
//columnLines = b[1];
columnSolids = b[2];
# ----------------------------------------
code_block_3 = CodeBlock(floors=code_block_2.solidsFloors) { floors; }
code_block_4 = CodeBlock(floors=code_block_3) { floors[0]; }
python_script = Python(IN[0]=code_block_4)
# ---------- python_script.python (13 lines) ----------
# Load the Python Standard and DesignScript Libraries
import sys
import clr
clr.AddReference('ProtoGeometry')
from Autodesk.DesignScript.Geometry import *

# The inputs to this node will be stored as a list in the IN variables.
dataEnteringNode = IN
floor = IN[0]
# Place your code below this line
crv = Solid.Explode(floor)
# Assign your output to the OUT variable.
OUT = crv
# ----------------------------------------
watch = Watch(python_script)
code_block_5 = CodeBlock(crv=python_script) { crv[0]; }

# group: Convert surface to curve and make points at parameter
perimeterCurves = Surface.PerimeterCurves(surface=code_block_5)
code_block_6 = CodeBlock(crv=perimeterCurves) { crv[0]; }
code_block_7 = CodeBlock { 0..1..#20; }
pointAtParameter = Curve.PointAtParameter(curve=code_block_6, param=code_block_7)
code_block_8 = CodeBlock(crv=perimeterCurves) { crv[2]; }
pointAtParameter_2 = Curve.PointAtParameter(curve=code_block_8, param=code_block_7)

# group: Find middlepoints
byStartPointEndPoint = Line.ByStartPointEndPoint(startPoint=pointAtParameter, endPoint=pointAtParameter_2)
code_block_9 = CodeBlock { 0.5; }
pointAtParameter_3 = Curve.PointAtParameter(curve=byStartPointEndPoint, param=code_block_9)

# group: Create outer points with lines and translate points normal to surface
normalAtPoint = Surface.NormalAtPoint(surface=code_block_5, point=pointAtParameter_3)
code_block_10 = CodeBlock { 0.4; }
byStartPointDirectionLength = Line.ByStartPointDirectionLength(startPoint=pointAtParameter_3, direction=normalAtPoint, length=code_block_10)
translate = Geometry.Translate(geometry=pointAtParameter_3, direction=normalAtPoint, distance=code_block_10)

# group: Create Lines through outer points
count = List.Count(list=translate)
code_block_11 = CodeBlock(l=count) { l-1; }
chop = List.Chop(list=translate, lengths=code_block_11)
code_block_12 = CodeBlock(l=chop) { l[0]; l[1]; }
join = List.Join(list0=code_block_12.out1, list1=code_block_12.out0)
byStartPointEndPoint_2 = Line.ByStartPointEndPoint(startPoint=translate, endPoint=join)

code_block_13 = CodeBlock { n = 20; }
python_script_2 = Python(IN[0]=code_block_3, IN[1]=code_block_13)
# ---------- python_script_2.python (154 lines) ----------
# Load the Python Standard and DesignScript Libraries
import sys
import clr
clr.AddReference('ProtoGeometry')
from Autodesk.DesignScript.Geometry import *

# The inputs to this node will be stored as a list in the IN variables.
dataEnteringNode = IN
floors = IN[0]
n_points = IN[1]
surfaces = []
curves = []
facade_points = []
facade_lines = []

def getItList(n):
	step = 1/float(n)
	o_list = []
	for i in range(int(n)):
		o_list.append(i*step)
	return o_list
	
def create_pipe(line, diam):
	st_pt = line.PointAtParameter(0)
	end_pt = line.PointAtParameter(1)
	n_vec = Vector.ByTwoPoints(st_pt, end_pt)
	plane = Plane.ByOriginNormal(st_pt, n_vec)
	circle_1 = Circle.ByPlaneRadius(plane, diam/2)
	solid = Curve.ExtrudeAsSolid(circle_1, n_vec)
	return solid
	
# Place your code below this line
for floor in floors:
	solid = Solid.Explode(floor)
	surface = solid[0]
	surfaces.append(surface)
	
	crv = surface.PerimeterCurves()
	curves.append(crv)
	
	params = getItList(n_points)
	facade_i_points = []
	
	for p in params:
		b_point = crv[0].PointAtParameter(p)
		t_point = crv[2].PointAtParameter(p)
		
		line = Line.ByStartPointEndPoint(b_point, t_point)
		m_point = line.PointAtParameter(0.5)
		
		n_vec = surface.NormalAtPoint(m_point)
		
		dist = 0.4
		
		new_m_point = m_point.Translate(n_vec, dist)
		facade_i_points.append(new_m_point)
		
		facade_line = Line.ByStartPointEndPoint(m_point, new_m_point)
		facade_lines.append(create_pipe(facade_line, 0.2))
		
	facade_points.append(facade_i_points)

distance_floors = facade_points[1][0].Z-facade_points[0][0].Z
v = Vector.ByCoordinates(0, 0, 1)

'''
This is a solution if the floors are of same size
'''
new_facade_points = []
new_facade_lines = []
conn_bowls = []
new_facade_points.append(facade_points[0])
for i in range(len(facade_points)-1):
	new_i_points = []
	conn_i_bowls = []
	new_facade_i_lines = []
	for j in range(len(facade_points[i])):
		new_point = new_facade_points[i][j].Translate(v, distance_floors)
		z = new_point.Z
		
		#make a circle to find the centerpoint for the old points, to find center
		circle = Circle.ByBestFitThroughPoints(facade_points[i+1])
		center = circle.CenterPoint
		
		#Make two lines to find the relation between them from old line to new line
		old_line = Line.ByStartPointEndPoint(center, facade_points[i+1][j])
		new_line = Line.ByStartPointEndPoint(center, new_point)
		
		line_vec = new_line.Direction
		#the distance to the new point
		relation = old_line.Length/new_line.Length
		
		'''
		Could calculate a relation for the distance to inner circle (distance-length(facade_connector))
		'''
		
		#the new point to be included
		new_point = new_line.PointAtParameter(relation)
		conn_bowl = Sphere.ByCenterPointRadius(new_point, 0.4/2)
		conn_i_bowls.append(conn_bowl)
		
		facade_line = Line.ByStartPointDirectionLength(new_point, line_vec, -0.4)
		new_facade_i_lines.append(create_pipe(facade_line, 0.1))
		#Can calculate length from center to new point by measuring distance from center to old point in facade_points[i+1] ? -> Yepp!
		new_i_points.append(new_point)
	new_facade_lines.append(new_facade_i_lines)
	new_facade_points.append(new_i_points)
	conn_bowls.append(conn_i_bowls)
# Set facade_points = new_facade_points if all floors are of same size
facade_points = new_facade_points

beams = []
columns = []
diags = []
for i in range(len(facade_points)-1):
	i_columns = []
	for j in range(len(facade_points[i])):
		column = Line.ByStartPointEndPoint(facade_points[i][j], facade_points[i+1][j])
		#Vary diameter here
		column = create_pipe(column, 0.2)
		i_columns.append(column)
	columns.append(i_columns)

# Make internal beams and diagonals
for i in range(len(facade_points)):
	i_beams = []
	i_diag = []
	for j in range(len(facade_points[i])-1):
		beam = Line.ByStartPointEndPoint(facade_points[i][j], facade_points[i][j+1])
		beam = create_pipe(beam, 0.2)
		i_beams.append(beam)
		if i <= len(facade_points)-2:
			diag = Line.ByStartPointEndPoint(facade_points[i][j], facade_points[i+1][j+1])
			diag = create_pipe(diag, 0.2)
			i_diag.append(diag)
			if j > 0:
				new_diag = Line.ByStartPointEndPoint(facade_points[i][j], facade_points[i+1][j-1])
				new_diag = create_pipe(new_diag, 0.2)
				i_diag.append(new_diag)
			
	beam = Line.ByStartPointEndPoint(facade_points[i][0], facade_points[i][-1])
	beam = create_pipe(beam, 0.2)
	i_beams.append(beam)
	# Have to draw the last one from first to last
	if i <= len(facade_points)-2:
		diag = Line.ByStartPointEndPoint(facade_points[i][-1], facade_points[i+1][0])
		diag = create_pipe(diag, 0.2)
		i_diag.append(diag)
	
	diags.append(i_diag)
	beams.append(i_beams)		
# Assign your output to the OUT variable.
#OUT = facade_points, facade_lines, columns, beams, new_facade_points
OUT = beams, columns, diags, conn_bowls, new_facade_lines
# ----------------------------------------
code_block_14 = CodeBlock(curves=python_script_2) { curves; }
watch_2 = Watch(python_script_2)
code_block_15 = CodeBlock(OUT=python_script_2) { OUT[3]; }
