# Dynamo graph model.dyn (Dynamo 2.6.1.8786)

input_facade = CodeBlock()
# ---------- input_facade.designscript (23 lines) ----------
pt1 = Point.ByCoordinates(30,0,0);
pt2 = Point.ByCoordinates(30,0,25);
pt3 = Point.ByCoordinates(30,0,50);

pts = [pt1,pt3];

cir1 = Circle.ByCenterPointRadius(pt1,15);
cir2 = Circle.ByCenterPointRadius(pt2,15);
cir3 = Circle.ByCenterPointRadius(pt3,15);

pol1 = Polygon.RegularPolygon(cir1, 5);
pol2 = Polygon.RegularPolygon(cir2, 5);
pol3 = Polygon.RegularPolygon(cir3, 5);


cirs = [cir1,cir2,cir3];
polygons = [pol1, pol2, pol3];

srf = Surface.ByLoft(cirs);
//srf = Surface.ByLoft(polygons);

srf2 = Surface.ByLoft(polygons);
numberOfFloors = 8;
# ----------------------------------------
create_floors_python = Python(IN[0]=input_facade.pts, IN[1]=input_facade.srf, IN[2]=input_facade.numberOfFloors)
# ---------- create_floors_python.python (53 lines) ----------
# Load the Python Standard and DesignScript Libraries
import sys
import clr
clr.AddReference('ProtoGeometry')
from Autodesk.DesignScript.Geometry import *

def createZcoordFloors(ptB, ptT, nFloors):
	dist = Point.DistanceTo(ptB,ptT)
	span = dist/nFloors
	i =0
	zcord=ptB.Z
	zcords = []
	while i< 1000:
		if zcord > ptT.Z:
			break
		else:
			zcords.append(zcord)
		i += 1
		zcord = zcord + span
	return [zcords,span]

# The inputs to this node will be stored as a list in the IN variables.
dataEnteringNode = IN

pts = IN[0]
srf = IN[1]
nFl = IN[2]
# Place your code below this line
zcords = createZcoordFloors(pts[0],pts[1], nFl)
floorH = zcords[1]

plns = []
crvs = []
srfs = []
sols = []
for z in zcords[0]:
	vecZ = Vector.ByCoordinates(0,0,1)
	ori = Point.ByCoordinates(0,0,z)
	
	pln = Plane.ByOriginNormal(ori, vecZ)
	plns.append(pln)
	
	crv = Plane.Intersect(pln,srf)[0]
	crvs.append(crv)
	
	nsrf = Surface.ByPatch(crv)
	srfs.append(nsrf)
	
	sol = Curve.ExtrudeAsSolid(crv,0.2)
	sols.append(sol)

# Assign your output to the OUT variable.
OUT = [plns,crvs,srfs, sols]
# ----------------------------------------
code_block = CodeBlock { xspan = 8; yspan = 8; spans = [xspan,yspan]; }
create_columns_python = Python(IN[0]=create_floors_python, IN[1]=code_block.spans)
# ---------- create_columns_python.python (77 lines) ----------
# Load the Python Standard and DesignScript Libraries
import sys
import clr
clr.AddReference('ProtoGeometry')
from Autodesk.DesignScript.Geometry import *


def createDomain(min,max,step):
	domain = [0]
	i=0
	number1 = 0
	number2 = 0
	while i < 100:
		i +=1
		number1 = number1 + step
		number2 = number2 - step
		if number1 <= max:
			domain.append(number1)
		
		if number2 >= min:
			domain.append(number2)
		
	domain.sort()
	return domain
	
def comparePtsOnFloors(pt1,pt2):
	res = 0
	if pt1.X == pt2.X and pt1.Y == pt2.Y:
		res = 1
	return res
# The inputs to this node will be stored as a list in the IN variables.
dataEnteringNode = IN

pls = IN[0][0]
edges = IN[0][1]
floors = IN[0][2]
spanX = IN[1][0]
spanY = IN[1][1]
# Place your code below this line

pts = []


for i in range(pls.Count):
	pl = pls[i]
	floor = floors[i]
	bob = BoundingBox.ByGeometry(floor)
	pb1 = bob.MinPoint
	pb2 = bob.MaxPoint
	domainX = createDomain(pb1.X, pb2.X, spanX)
	domainY = createDomain(pb1.Y, pb2.Y, spanY)
	ipts = []
	for ix in domainX:
		for jy in domainY:
			pt = Point.ByCoordinates(ix,jy, pl.Origin.Z)
			dist = Surface.DistanceTo(floor,pt)
			if dist == 0:
				ipts.append(pt)
	pts.append(ipts)
scolumns =[]	
columns = []
for j in range(pls.Count -1):
	ptsThisFloor = pts[j]
	ptsNextFloor = pts[j+1]
	icolumns = []
	for pt1 in ptsThisFloor:
		for pt2 in ptsNextFloor:
			if comparePtsOnFloors(pt1,pt2) == 1:
				col = Line.ByStartPointEndPoint(pt1,pt2)
				sec = Circle.ByCenterPointRadius(pt1,0.1)
				vec = Vector.ByTwoPoints(pt1,pt2)
				sol = Curve.ExtrudeAsSolid(sec,vec)
				scolumns.append(sol)
				icolumns.Add(col)
	columns.append(icolumns)
# Assign your output to the OUT variable.
OUT = [pts,columns,scolumns]
# ----------------------------------------
code_block_2 = CodeBlock(a=create_floors_python)
# ---------- code_block_2.designscript (8 lines) ----------
//planes =a[0];
//curves =a[1];
//surfaces =a[2];
solidsFloors =a[3];

//columnPoints = b[0];
//columnLines = b[1];
//columnSolids = b[2];
# ----------------------------------------
code_block_3 = CodeBlock { 5; 0.7; 0.1; 0.4; }
create_exterior_lines = Python(IN[0]=code_block_2, IN[1]=code_block_3.out0, IN[2]=code_block_3.out1, IN[3]=code_block_3.out2, IN[4]=code_block_3.out3)
# ---------- create_exterior_lines.python (109 lines) ----------
# Load the Python Standard and DesignScript Libraries
import sys
import clr
clr.AddReference('ProtoGeometry')
from Autodesk.DesignScript.Geometry import *

def find_middle_curve(curve_t, curve_b):
	pt_b = curve_b.PointAtParameter(0)
	pt_t = curve_t.PointAtParameter(0)
	line = Line.ByStartPointEndPoint(pt_b, pt_t)
	pt_m = line.PointAtParameter(0.5)
	vec = Vector.ByTwoPoints(pt_b, pt_m)
	curve_m = Curve.Translate(curve_b, vec)
	return curve_m

def frange(n):
	step = 1/float(n)
	o_list = []
	for i in range(int(n)):
		o_list.append(i*step)
	return o_list

def create_pipe(line, diam):
	st_pt = line.PointAtParameter(0)
	end_pt = line.PointAtParameter(1)
	n_vec = Vector.ByTwoPoints(st_pt, end_pt)
	plane = Plane.ByOriginNormal(st_pt, n_vec)
	circle_1 = Circle.ByPlaneRadius(plane, diam/2)
	solid = Curve.ExtrudeAsSolid(circle_1, n_vec)
	return solid

# The inputs to this node will be stored as a list in the IN variables.
dataEnteringNode = IN

#Inputs
input_floors = IN[0]

floor_edge_surfaces = []
floor_curves = []
floor_anch_points = []
facade_c_points = []
conn_pipes = []
conn_bowls = []

n_anch_points = IN[1]
offset_connectors = IN[2]
dia_pipes = IN[3]
sphere_dia = IN[4]

facade_pipe_dia = 0.2
beam_pipe_dia = 0.2

for floor in input_floors:
	f_solids = Solid.Explode(floor)
	floor_edge_surface = f_solids[0]
	floor_edge_surfaces.append(floor_edge_surface)
	floor_i_curves = Surface.PerimeterCurves(floor_edge_surface)
	floor_curves.append(floor_i_curves[0])
	curve_m = find_middle_curve(floor_i_curves[0],floor_i_curves[2])
	floor_curves.append(curve_m)
	floor_curves.append(floor_i_curves[2])
	param_list = frange(n_anch_points)
	
	floor_i_anch_points = []
	facade_i_c_points = []
	conn_i_pipes = []
	conn_i_bowls = []
	
	for p in param_list:
		anch_pt = curve_m.PointAtParameter(p)
		floor_i_anch_points.append(anch_pt)
		vec_normal = Surface.NormalAtPoint(floor_edge_surface, anch_pt)
		conn_pt = Point.Translate(anch_pt, vec_normal, offset_connectors)
		facade_i_c_points.append(conn_pt)
		conn_line = Line.ByStartPointEndPoint(anch_pt, conn_pt)
		conn_pipe = create_pipe(conn_line, dia_pipes)
		conn_i_pipes.append(conn_pipe)
		conn_bowl = Sphere.ByCenterPointRadius(conn_pt, sphere_dia/2)
		conn_i_bowls.append(conn_bowl)
		
	conn_bowls.append(conn_i_bowls)
	conn_pipes.append(conn_i_pipes)
	floor_anch_points.append(floor_i_anch_points)
	facade_c_points.append(facade_i_c_points)

list = []
facade_cols = []
facade_beams = []

for i in range(facade_c_points.Count-1):
	for j in range(facade_c_points[i].Count):
		pt_bt_fl = facade_c_points[i][j]
		pt_tp_fl = facade_c_points[i+1][j]
		v_line = Line.ByStartPointEndPoint(pt_bt_fl, pt_tp_fl)
		facade_col = create_pipe(v_line, facade_pipe_dia/2)
		facade_cols.append(facade_col)	

for i in range(facade_c_points.Count):
	facade_c_points[i].append(facade_c_points[i][0])
	for j in range(facade_c_points[i].Count-1):
		pt_bt_fl = facade_c_points[i][j]
		pt_tp_fl = facade_c_points[i][j+1]
		h_line = Line.ByStartPointEndPoint(pt_bt_fl, pt_tp_fl)
		facade_beam = create_pipe(h_line, beam_pipe_dia/2)
		facade_beams.append(facade_beam)
	
# Assign your output to the OUT variable.
#OUT = [floor_anch_points, facade_c_points, conn_pipes, conn_bowls]
OUT = [facade_cols, facade_beams, conn_bowls, conn_pipes]
# ----------------------------------------
watch = Watch(create_exterior_lines)
code_block_4 = CodeBlock(pts=input_facade.srf2) { pts; }
code_block_5 = CodeBlock()
# ---------- code_block_5.designscript (20 lines) ----------
pt1 = Point.ByCoordinates(0,0,0);
pt2 = Point.ByCoordinates(0,0,20);
pt3 = Point.ByCoordinates(0,0,40);

pts = [pt1,pt3];

cir1 = Circle.ByCenterPointRadius(pt1,10);
cir2 = Circle.ByCenterPointRadius(pt2,14);
cir3 = Circle.ByCenterPointRadius(pt3,20);

pol1 = Polygon.RegularPolygon(cir1, 15);
pol2 = Polygon.RegularPolygon(cir2, 15);
pol3 = Polygon.RegularPolygon(cir3, 15);

cirs = [cir1, cir2, cir3];
polygons = [pol1, pol2, pol3];

//srf = Surface.ByLoft(polygons);
srf = Surface.ByLoft(cirs);
nFls = 10;
# ----------------------------------------

# group: Parameters
n_sides_polygon = IntegerSlider(10, range=0..10 step 1)
dia_pipes = DoubleSlider(0.3, range=0..1 step 0.1)
dia_sphere = DoubleSlider(0.6, range=0..1 step 0.1)
xspan = IntegerSlider(6, range=0..10 step 1)
yspan = IntegerSlider(4, range=0..10 step 1)

# group: Create Floors, Points, Polygons and Surfaces
create_floors_python_2 = Python(IN[0]=code_block_5.pts, IN[1]=code_block_5.srf, IN[2]=code_block_5.nFls)
# ---------- create_floors_python_2.python (53 lines) ----------
# Load the Python Standard and DesignScript Libraries
import sys
import clr
clr.AddReference('ProtoGeometry')
from Autodesk.DesignScript.Geometry import *

def createZcoordFloors(ptB, ptT, nFloors):
	dist = Point.DistanceTo(ptB,ptT)
	span = dist/nFloors
	i =0
	zcord=ptB.Z
	zcords = []
	while i< 1000:
		if zcord > ptT.Z:
			break
		else:
			zcords.append(zcord)
		i += 1
		zcord = zcord + span
	return [zcords,span]

# The inputs to this node will be stored as a list in the IN variables.
dataEnteringNode = IN

pts = IN[0]
srf = IN[1]
nFl = IN[2]
# Place your code below this line
zcords = createZcoordFloors(pts[0],pts[1], nFl)
floorH = zcords[1]

plns = []
crvs = []
srfs = []
sols = []
for z in zcords[0]:
	vecZ = Vector.ByCoordinates(0,0,1)
	ori = Point.ByCoordinates(0,0,z)
	
	pln = Plane.ByOriginNormal(ori, vecZ)
	plns.append(pln)
	
	crv = Plane.Intersect(pln,srf)[0]
	crvs.append(crv)
	
	nsrf = Surface.ByPatch(crv)
	srfs.append(nsrf)
	
	sol = Curve.ExtrudeAsSolid(crv,0.2)
	sols.append(sol)

# Assign your output to the OUT variable.
OUT = [plns,crvs,srfs,sols]
# ----------------------------------------
code_block_6 = CodeBlock(a=create_floors_python_2)
# ---------- code_block_6.designscript (10 lines) ----------
planes =a[0];
curves =a[1];
//surfaces =a[2];
//solidsFloors =a[3];


//srf = surfaces[2];
//columnPoints = b[0];
//columnLines = b[1];
//columnSolids = b[2];
# ----------------------------------------
code_block_7 = CodeBlock(crvs=code_block_6.curves) { crvs; }
code_block_8 = CodeBlock(n=n_sides_polygon) { n; 1/n; }
convert_from_circle_to_polygon = Python(IN[0]=code_block_7, IN[1]=code_block_8.n, IN[2]=code_block_8.out1, IN[3]=code_block_6.planes)
# ---------- convert_from_circle_to_polygon.python (34 lines) ----------
# Load the Python Standard and DesignScript Libraries
import sys
import clr
clr.AddReference('ProtoGeometry')
from Autodesk.DesignScript.Geometry import *

# The inputs to this node will be stored as a list in the IN variables.
dataEnteringNode = IN
curves = IN[0]
nPolyDeg = IN[1]
it = IN[2]
planes = IN[3]
# Place your code below this line
iter = [x*it for x in range(0, nPolyDeg)]

pointList = []
nsurfaces = []
sols = []
for n, curve in enumerate(curves):
	points=[]
	for i in iter:
		if n == 0:
			p = Curve.PointAtParameter(curve, i+0.07)
		else:
			p = Curve.PointAtParameter(curve, i)
		points.append(p)
	poly = Polygon.ByPoints(points)
	nsrf = Surface.ByPatch(poly)
	nsurfaces.append(nsrf)
	sol = Curve.ExtrudeAsSolid(poly,0.2)
	sols.append(sol)
	pointList.append(points)
# Assign your output to the OUT variable.
OUT = [planes, curves, nsurfaces, sols, pointList]
# ----------------------------------------
code_block_9 = CodeBlock(OUT=convert_from_circle_to_polygon) { points = OUT[4]; }

code_block_10 = CodeBlock(dia_pipes=dia_pipes, dia_s=dia_sphere) { 0.1; dia_pipes; 0.4; dia_s; }

# group: Params for roof
code_block_11 = CodeBlock { nCircles = 8; }
code_block_12 = CodeBlock { 20; }

# group: Create lines for roof
code_block_13 = CodeBlock(points=code_block_9) { ptsTopFloor = points[-1]; }
byBestFitThroughPoints = Circle.ByBestFitThroughPoints(points=code_block_13)
centerPoint = Circle.CenterPoint(circle=byBestFitThroughPoints)
code_block_14 = CodeBlock(circ=byBestFitThroughPoints) { circ; r = circ.Radius; }
code_block_15 = CodeBlock(u=code_block_12) { it = 0..1..#u; }
python_script = Python(IN[0]=byBestFitThroughPoints, IN[1]=centerPoint, IN[2]=code_block_14.r, IN[3]=code_block_11, IN[4]=code_block_8.n, IN[5]=code_block_15)
# ---------- python_script.python (61 lines) ----------
# Load the Python Standard and DesignScript Libraries
import sys
import clr
clr.AddReference('ProtoGeometry')
from Autodesk.DesignScript.Geometry import *

# The inputs to this node will be stored as a list in the IN variables.
dataEnteringNode = IN

circle = IN[0]
midPt = IN[1]
r = IN[2]
nCircs = IN[3]
n = IN[4]
it_vect = IN[5]
# Place your code below this line
i = round(r)
it = round(r/nCircs)

circleList = []
polList = []
ptsList = []
linesList = []
pol = Polygon.RegularPolygon(circle, n)
polList.append(pol)
while i > it+1:
	i-=it
	circle = Circle.ByCenterPointRadius(midPt, i)
	pol = Polygon.RegularPolygon(circle, n)
	circleList.append(circle)
	polList.append(pol)
	
for polygon in polList:
	pts = []
	for i in it_vect:
		pt = Curve.PointAtParameter(polygon, i)
		pts.append(pt)
	ptsList.append(pts)
	
for i in range(len(ptsList)-1):
	lines = []
	for j in range(len(ptsList[i])):
		line = Line.ByStartPointEndPoint(ptsList[i][j], ptsList[i+1][j])
		lines.append(line)
		#if i == len(ptsList)-2:
		#	line = Line.ByStartPointEndPoint(ptsList[i+1][j], midPt)
		#	lines.append(line)
	linesList.append(lines)

for i in range(len(ptsList)):
	lines = []
	for j in range(len(ptsList[i])-1):
		line = Line.ByStartPointEndPoint(ptsList[i][j], ptsList[i][j+1])
		lines.append(line)
		if i == len(ptsList)-2:
			line = Line.ByStartPointEndPoint(ptsList[i+1][j], midPt)
			lines.append(line)
	linesList.append(lines)

# Assign your output to the OUT variable.
OUT = ptsList, linesList
# ----------------------------------------

# group: Prepare for FDM
code_block_16 = CodeBlock(out=python_script) { lines = out[1]; }
flatten = List.Flatten(list=code_block_16)
count = List.Count(list=flatten)
code_block_17 = CodeBlock(l=count) { l; q = 1..1..#l; }

# group: FDM
branch_force_pair = Python(IN[0]=flatten, IN[1]=code_block_17.q)
# ---------- branch_force_pair.python (31 lines) ----------
# Load the Python Standard and DesignScript Libraries
import sys
import clr
clr.AddReference('ProtoGeometry')
from Autodesk.DesignScript.Geometry import *

# The inputs to this node will be stored as a list in the IN variables.
dataEnteringNode = IN

# Place your code below this line
lines = IN[0]
q = IN[1]

#create class
class Pair():
	count = 0
	#Constructor
	def __init__(self, _line, _ratio):
		#Properties
		self.Id = Pair.count
		self.line = _line
		self.ratio = _ratio
		
		Pair.count += 1

#Create a list of lines and branch force density
lines_and_q = [Pair(lines[i], q[i]) for i in range(len(lines))]

# Assign your output to the OUT variable.
#OUT = lines_and_q
OUT = lines_and_q
# ----------------------------------------
supPts = CodeBlock(out=python_script) { pts = out[0][0]; }
code_block_18 = CodeBlock { f_vec = Vector.ByCoordinates(0, 0, 0.3); }
file_path = Filename("..\..\TKT4198\Form Finding\MathNet.Numerics.dll")
python_script_2 = Python(IN[0]=branch_force_pair, IN[1]=supPts, IN[2]=code_block_18, IN[3]=file_path)
# ---------- python_script_2.python (137 lines) ----------
# Load the Python Standard and DesignScript Libraries
import sys
import clr
clr.AddReference('ProtoGeometry')
from Autodesk.DesignScript.Geometry import *
from clr import AddReferenceToFileAndPath as addref

dataEnteringNode = IN

path = IN[3]
addref(path)
import MathNet.Numerics.LinearAlgebra as la

#Input
branches = IN[0]
supPts = IN[1]
force_vec = IN[2]

#Functions
def sorted_points(branches, sup_pts):
	sortedPts = []
	sortedPts += sup_pts
	
	for b in branches:
		sPt = b.line.StartPoint
		ePt = b.line.EndPoint
		addit1 = 1
		addit2 = 1
		for p in sortedPts:
			if (p.DistanceTo(sPt) < 0.001):
				addit1 = 0
			if (p.DistanceTo(ePt) < 0.001):
				addit2 = 0
		if (addit1 == 1):
			sortedPts.append(sPt)
		if (addit2 == 1):
			sortedPts.append(ePt)
	del sortedPts[:len(supPts)]
	return (sortedPts+supPts)
	
	
def branch_Node_matrix(branches, sortedPts):
	c = la.Double.Matrix.Build.Dense(len(branches), len(sortedPts))
	
	#Filling in correct indexes
	for b in branches:
		row = b.Id 
		sPt = b.line.StartPoint
		ePt = b.line.EndPoint
		col1 = 0
		col2 = 0
		i = 0
		
		for p in sortedPts:
			if sPt.DistanceTo(p) < 0.001:
				col1 = i
			if ePt.DistanceTo(p) < 0.001:
				col2 = i	
			i += 1
			
		c[row, col1] = 1
		c[row, col2] = -1
	return c

def force_density_vector(branches):
	q = la.Double.Vector.Build.Dense(len(branches))
	
	for i in range(len(branches)):
		q[i] = branches[i].ratio
	return q

def CoordinateVectors(sortedPts):
	v = la.Double.Vector.Build
	x = v.Dense(len(sortedPts))
	y = v.Dense(len(sortedPts))
	z = v.Dense(len(sortedPts))
	for i in range(len(sortedPts)):
		x[i] = sortedPts[i].X
		y[i] = sortedPts[i].Y		
		z[i] = sortedPts[i].Z
	return [x, y, z]

def dMatrices(cMat, qVec, supPts):
	m = la.Double.Matrix.Build
	qMat = m.DiagonalOfDiagonalVector(qVec)
	
	#Subtract the cN and cF of the C-matrix
	cN = la.Double.DenseMatrix.SubMatrix(cMat, 0, cMat.RowCount, 0, cMat.ColumnCount - len(supPts))
	
	cF = la.Double.DenseMatrix.SubMatrix(cMat, 0, cMat.RowCount, cMat.ColumnCount - len(supPts), len(supPts))
	
	#Calculating dN and dF matrix
	cNt = cN.Transpose()
	dN = cNt*qMat*cN
	dF = cNt*qMat*cF
	return dN, dF
def NewLines(cMat, newFreePts, supPts):
	newPts = []
	newLines = []
	
	for i in range(len(newFreePts[0])):
		newPts.append(Point.ByCoordinates(newFreePts[0][i],newFreePts[1][i], newFreePts[2][i]))
	newPts += supPts
	
	for row in range(cMat.RowCount):
		for col in range(cMat.ColumnCount):
			if cMat[row, col] == 1:
				sPt = newPts[col]
			if cMat[row, col] == -1:
				ePt = newPts[col]
		if not (sPt == ePt):
			newLines.append(Line.ByStartPointEndPoint(sPt, ePt))
	return newLines			
		
	
sortedPts = sorted_points(branches, supPts)
cMat = branch_Node_matrix(branches, sortedPts)
qVec = force_density_vector(branches)

dN, dF = dMatrices(cMat, qVec, supPts)
coordVec = CoordinateVectors(sortedPts)

xf = la.Double.DenseVector.SubVector(coordVec[0], len(coordVec[0])-len(supPts), len(supPts))
yf = la.Double.DenseVector.SubVector(coordVec[1], len(coordVec[0])-len(supPts), len(supPts))
zf = la.Double.DenseVector.SubVector(coordVec[2], len(coordVec[0])-len(supPts), len(supPts))

px = la.Double.Vector.Build.Dense(len(sortedPts)-len(supPts), force_vec.X)
py = la.Double.Vector.Build.Dense(len(sortedPts)-len(supPts), force_vec.Y)
pz = la.Double.Vector.Build.Dense(len(sortedPts)-len(supPts), force_vec.Z)

xN = dN.Solve(px-dF*xf)
yN = dN.Solve(py-dF*yf)
zN = dN.Solve(pz-dF*zf)

newLines = NewLines(cMat, [xN, yN, zN], supPts)
# Assign your output to the OUT variable.
OUT = newLines
# ----------------------------------------

# group: Create solid trusses for roof
code_block_19 = CodeBlock { 0.1; }
python_script_3 = Python(IN[0]=python_script_2, IN[1]=code_block_19, IN[2]=code_block_17.q)
# ---------- python_script_3.python (25 lines) ----------
# Load the Python Standard and DesignScript Libraries
import sys
import clr
clr.AddReference('ProtoGeometry')
from Autodesk.DesignScript.Geometry import *

# The inputs to this node will be stored as a list in the IN variables.
dataEnteringNode = IN
inLines = IN[0]
radius = IN[1]
q = IN[2]

cylinderList = []
for i, line in enumerate(inLines):
	sPt = line.StartPoint
	ePt = line.EndPoint
	cylinder = Cylinder.ByPointsRadius(sPt, ePt, q[i]*radius)
	cylinderList.append(cylinder)
	#Calculate epsilon by delta L / L 
	#Calculate Force by epsilon*A(defined by A_0*q[i])*E
	#Return a class Line with force?
# Place your code below this line

# Assign your output to the OUT variable.
OUT = cylinderList
# ----------------------------------------

code_block_20 = CodeBlock(xspan=xspan, yspan=yspan) { xspan; yspan; spans = [xspan,yspan]; }

# group: Resulting Building
code_block_21 = CodeBlock(a=convert_from_circle_to_polygon)  # same code as code_block_2
create_exterior_lines_2 = Python(IN[0]=code_block_21, IN[1]=code_block_8.n, IN[3]=code_block_10.dia_pipes, IN[4]=code_block_10.dia_s, IN[5]=code_block_9)  # unwired: IN[2]
# ---------- create_exterior_lines_2.python (84 lines) ----------
# Load the Python Standard and DesignScript Libraries
import sys
import clr
clr.AddReference('ProtoGeometry')
from Autodesk.DesignScript.Geometry import *

def find_middle_curve(curve_t, curve_b):
	pt_b = curve_b.PointAtParameter(0)
	pt_t = curve_t.PointAtParameter(0)
	line = Line.ByStartPointEndPoint(pt_b, pt_t)
	pt_m = line.PointAtParameter(0.5)
	vec = Vector.ByTwoPoints(pt_b, pt_m)
	curve_m = Curve.Translate(curve_b, vec)
	return curve_m

def frange(n):
	step = 1/float(n)
	o_list = []
	for i in range(int(n)):
		o_list.append(i*step)
	return o_list

def create_pipe(line, diam):
	st_pt = line.PointAtParameter(0)
	end_pt = line.PointAtParameter(1)
	n_vec = Vector.ByTwoPoints(st_pt, end_pt)
	plane = Plane.ByOriginNormal(st_pt, n_vec)
	circle_1 = Circle.ByPlaneRadius(plane, diam/2)
	solid = Curve.ExtrudeAsSolid(circle_1, n_vec)
	return solid

# The inputs to this node will be stored as a list in the IN variables.
dataEnteringNode = IN

#Inputs
input_floors = IN[0]

floor_edge_surfaces = []
floor_curves = []
floor_anch_points = []
facade_c_points = []
conn_pipes = []
conn_bowls = []

n_anch_points = IN[1]
offset_connectors = IN[2]
dia_pipes = IN[3]
sphere_dia = IN[4]
inPoints = IN[5]


facade_pipe_dia = 0.2
beam_pipe_dia = 0.2

column_list = []
beam_list = []
conn_bowls = []
for i in range(len(inPoints)-1):
	i_cols = []
	for j in range(len(inPoints[i])):
		line = Line.ByStartPointEndPoint(inPoints[i][j], inPoints[i+1][j])
		i_cols.append(create_pipe(line, beam_pipe_dia))
		if i == len(inPoints)-2 and j < len(inPoints[i])-1:
			line = Line.ByStartPointEndPoint(inPoints[i][j], inPoints[i+1][j+1])
			i_cols.append(create_pipe(line, beam_pipe_dia))
	column_list.append(i_cols)

for i in range(len(inPoints)):
	i_beams = []
	for j in range(len(inPoints[i])-1):
		line = Line.ByStartPointEndPoint(inPoints[i][j], inPoints[i][j+1])
		i_beams.append(create_pipe(line, beam_pipe_dia))
		if j == len(inPoints[i])-2:
			line = Line.ByStartPointEndPoint(inPoints[i][0], inPoints[i][j+1])
			i_beams.append(create_pipe(line, beam_pipe_dia))
	beam_list.append(i_beams)

for pointList in inPoints:
	i_conn_bowls = []
	for point in pointList:
		Sphere = Sphere.ByCenterPointRadius(point, sphere_dia/2)
		i_conn_bowls.append(Sphere)	
	conn_bowls.append(i_conn_bowls)
OUT = column_list, beam_list, conn_bowls	
# ----------------------------------------
create_columns_python_2 = Python(IN[0]=convert_from_circle_to_polygon, IN[1]=code_block_20.spans)  # same code as create_columns_python
code_block_22 = CodeBlock(OUT=create_columns_python_2) { pts = OUT[0]; }
code_block_23 = CodeBlock(OUT=create_columns_python_2) { columns = OUT[1]; }
code_block_24 = CodeBlock(OUT=create_columns_python_2) { scolumns = OUT[2]; }

input_facade_2 = CodeBlock()
# ---------- input_facade_2.designscript (23 lines) ----------
pt1 = Point.ByCoordinates(0,30,0);
pt2 = Point.ByCoordinates(0,30,25);
pt3 = Point.ByCoordinates(0,30,50);

pts = [pt1,pt3];

cir1 = Circle.ByCenterPointRadius(pt1,15);
cir2 = Circle.ByCenterPointRadius(pt2,15);
cir3 = Circle.ByCenterPointRadius(pt3,15);

pol1 = Polygon.RegularPolygon(cir1, 5);
pol2 = Polygon.RegularPolygon(cir2, 5);
pol3 = Polygon.RegularPolygon(cir3, 5);


cirs = [cir1,cir2,cir3];
polygons = [pol1, pol2, pol3];

srf = Surface.ByLoft(cirs);
//srf = Surface.ByLoft(polygons);

srf2 = Surface.ByLoft(polygons);
numberOfFloors = 8;
# ----------------------------------------
create_floors_python_3 = Python(IN[0]=input_facade_2.pts, IN[1]=input_facade_2.srf, IN[2]=input_facade_2.numberOfFloors)  # same code as create_floors_python
code_block_25 = CodeBlock(a=create_floors_python_3)  # same code as code_block_2
code_block_26 = CodeBlock { 5; 0.7; 0.1; 0.4; }
create_exterior_lines_3 = Python(IN[0]=code_block_25, IN[1]=code_block_26.out0, IN[2]=code_block_26.out1, IN[3]=code_block_26.out2, IN[4]=code_block_26.out3)  # same code as create_exterior_lines
watch_2 = Watch(create_exterior_lines_3)
code_block_27 = CodeBlock { xspan = 8; yspan = 8; spans = [xspan,yspan]; }
create_columns_python_3 = Python(IN[0]=create_floors_python_3, IN[1]=code_block_27.spans)  # same code as create_columns_python
code_block_28 = CodeBlock(pts=input_facade_2.srf2) { pts; }
input_facade_3 = CodeBlock()
# ---------- input_facade_3.designscript (23 lines) ----------
pt1 = Point.ByCoordinates(-30,0,0);
pt2 = Point.ByCoordinates(-30,0,20);
pt3 = Point.ByCoordinates(-30,0,40);

pts = [pt1,pt3];

cir1 = Circle.ByCenterPointRadius(pt1,15);
cir2 = Circle.ByCenterPointRadius(pt2,15);
cir3 = Circle.ByCenterPointRadius(pt3,15);

pol1 = Polygon.RegularPolygon(cir1, 5);
pol2 = Polygon.RegularPolygon(cir2, 5);
pol3 = Polygon.RegularPolygon(cir3, 5);


cirs = [cir1,cir2,cir3];
polygons = [pol1, pol2, pol3];

srf = Surface.ByLoft(cirs);
//srf = Surface.ByLoft(polygons);

srf2 = Surface.ByLoft(polygons);
numberOfFloors = 8;
# ----------------------------------------
create_floors_python_4 = Python(IN[0]=input_facade_3.pts, IN[1]=input_facade_3.srf, IN[2]=input_facade_3.numberOfFloors)  # same code as create_floors_python
code_block_29 = CodeBlock(a=create_floors_python_4)  # same code as code_block_2
code_block_30 = CodeBlock { 5; 0.7; 0.1; 0.4; }
create_exterior_lines_4 = Python(IN[0]=code_block_29, IN[1]=code_block_30.out0, IN[2]=code_block_30.out1, IN[3]=code_block_30.out2, IN[4]=code_block_30.out3)  # same code as create_exterior_lines
watch_3 = Watch(create_exterior_lines_4)
code_block_31 = CodeBlock { xspan = 8; yspan = 8; spans = [xspan,yspan]; }
create_columns_python_4 = Python(IN[0]=create_floors_python_4, IN[1]=code_block_31.spans)  # same code as create_columns_python
code_block_32 = CodeBlock(pts=input_facade_3.srf2) { pts; }
input_facade_4 = CodeBlock()
# ---------- input_facade_4.designscript (23 lines) ----------
pt1 = Point.ByCoordinates(0,-30,0);
pt2 = Point.ByCoordinates(0,-30,20);
pt3 = Point.ByCoordinates(0,-30,40);

pts = [pt1,pt3];

cir1 = Circle.ByCenterPointRadius(pt1,15);
cir2 = Circle.ByCenterPointRadius(pt2,15);
cir3 = Circle.ByCenterPointRadius(pt3,15);

pol1 = Polygon.RegularPolygon(cir1, 5);
pol2 = Polygon.RegularPolygon(cir2, 5);
pol3 = Polygon.RegularPolygon(cir3, 5);


cirs = [cir1,cir2,cir3];
polygons = [pol1, pol2, pol3];

srf = Surface.ByLoft(cirs);
//srf = Surface.ByLoft(polygons);

srf2 = Surface.ByLoft(polygons);
numberOfFloors = 8;
# ----------------------------------------
create_floors_python_5 = Python(IN[0]=input_facade_4.pts, IN[1]=input_facade_4.srf, IN[2]=input_facade_4.numberOfFloors)  # same code as create_floors_python
code_block_33 = CodeBlock(a=create_floors_python_5)  # same code as code_block_2
code_block_34 = CodeBlock { 5; 0.7; 0.1; 0.4; }
create_exterior_lines_5 = Python(IN[0]=code_block_33, IN[1]=code_block_34.out0, IN[2]=code_block_34.out1, IN[3]=code_block_34.out2, IN[4]=code_block_34.out3)  # same code as create_exterior_lines
watch_4 = Watch(create_exterior_lines_5)
code_block_35 = CodeBlock { xspan = 8; yspan = 8; spans = [xspan,yspan]; }
create_columns_python_5 = Python(IN[0]=create_floors_python_5, IN[1]=code_block_35.spans)  # same code as create_columns_python
code_block_36 = CodeBlock(pts=input_facade_4.srf2) { pts; }
