# Grasshopper definition para_design.gh (Grasshopper 1.0.7)
# plug-ins: Bifocals

# ----
# Water pond
curve = Curve(<curve referenced from the Rhino model>)
rectangle = Rectangle(curve)
deconstruct_plane = DeconstructPlane(Plane=rectangle)  # -> Origin, XAxis, YAxis, ZAxis
deconstruct = Deconstruct(Point=deconstruct_plane.Origin)  # -> XComponent, YComponent, ZComponent
construct_point = ConstructPoint(XCoordinate=deconstruct.XComponent, YCoordinate=deconstruct.YComponent, ZCoordinate="10")
line = Line(StartPoint=deconstruct_plane.Origin, EndPoint=construct_point)
curve_2 = Curve([<curve referenced from the Rhino model> x3])
revolution = Revolution(Curve=curve_2, Axis=line, Domain=Domain(0, 6.283185307))

ghpython_script = GhPythonScript()  # -> Out, A
ladybug = Ladybug_Ladybug()  # -> out; plug-in component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

# ----
# Change Azimuth Angle of Roof
# 0 = North
# (-90) = East
# 90 = West
number_slider = Slider(10, range=-90..90)

# ----
# Change Altitude Angle of Roof
# 0 = Horizontal
number_slider_2 = Slider(0, range=0..60)

# ----
# Run Energy Simulation
# Change radius of Courtyard
number_slider_3 = Slider(7, range=7..20)

honeybee = Honeybee_Honeybee()  # -> out; plug-in component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

# ----
# Change tilt of Courtyard
number_slider_4 = Slider(0, range=0..100)

# ----
# Change Height of Wind opening
# Outside
# Inside
number_slider_5 = Slider(30, range=0..30)
number_slider_6 = Slider(10, range=0..30)

# ----
# Choose Volume
# 45000m² Floor plan
# 4m height / floor
# = 180000m³
panel = Panel("200000")

python = PythonScript(slider=number_slider)  # -> out, a
# ---------- python: Python ----------
info = []

for input in ghenv.Component.Params.Input:
    for source in input.Sources:
        print input.Name
        if input.Name == "slider":
            a = str(source.InstanceGuid)
# ---------- end python ----------
panel_2 = Panel(python.a)
mass2zone = Honeybee_Masses2Zones(zoneMasses=flatten(revolution), maxRoofAngle=30)  # -> out, HBZones; plug-in component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
createepground = Honeybee_CreateEPGround(HBZones=mass2zone.HBZones)  # -> HBGrndZones; plug-in component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
honeybee_bldgprograms = Honeybee_bldgPrograms({"Office": 0, "Retail": 1, "MidriseApartment": 2, "PrimarySchool": 3, "SecondarySchool": 4, "SmallHotel": 5, "LargeHotel": 6, "Hospital": 7, "Outpatient": 8, "Warehouse": 9, "SuperMarket": 10, "FullServiceRestaurant": 11, "QuickServiceRestaurant": 12}, selected="Office")
listzoneprograms = Honeybee_ListZonePrograms(bldgProgram=honeybee_bldgprograms)  # -> OfficeZonePrograms; plug-in component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

# ----
# Creating Custom Window
panel_3 = Panel("Glazing")
epwindowmat = Honeybee_EnergyPlusWindowMaterial(name=panel_3, U_Value="0.8", SHGC="0.7", VT="0.7")  # -> EPMaterial; plug-in component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
epconstruction = Honeybee_EnergyPlusConstruction(name=panel_3, layer_1=epwindowmat)  # -> EPConstruction; plug-in component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

# ----
# Creating Custom Wall
panel_4 = Panel("Insulation")
epopaquemat = Honeybee_EnergyPlusOpaqueMaterial(name=panel_4, thickness="0.15", conductivity="0.035", density="100", specificHeat="830")  # -> EPMaterial; plug-in component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
epopaquemat_2 = Honeybee_EnergyPlusOpaqueMaterial(name="Concrete", thickness="0.36", conductivity="2", density="2400", specificHeat="950")  # -> EPMaterial; plug-in component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
epconstruction_2 = Honeybee_EnergyPlusConstruction(name="ExtWall", layer_1=epopaquemat, layer_2=epopaquemat_2)  # -> EPConstruction; plug-in component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

honeybee_hvacsystemslist = Honeybee_HVACSystemsList({"-1. Thermostat Only": -1, "0. Ideal Air Loads": 0, "1. PTAC | Residential": 1, "2. PTHP | Residential": 2, "3. Packaged Single Zone - AC": 3, "4. Packaged Single Zone - HP": 4, "5. Packaged VAV w/ Reheat": 5, "6. Packaged VAV w/ PFP Boxes": 6, "7. VAV w/ Reheat": 7, "8. VAV w/ PFP Boxes": 8, "9. Warm Air Furnace - Gas Fired": 9, "10.Warm Air Furnace - Electric": 10, "11.Fan Coil Units + DOAS": 11, "12.Active Chilled Beams + DOAS": 12, "13.Radiant Floors + DOAS": 13, "14.Custom Rad Surfaces + DOAS": 14, "15.Heated Surfaces + VAV Cooling": 15, "16.VRF + DOAS": 16, "17.WSHP + DOAS": 17}, selected="13.Radiant Floors + DOAS")

# ----
# Main Geometry
panel_5 = Panel("-110,-10,0")
_4point_surface = _4PointSurface(CornerA="-10,-10,0", CornerB=panel_5, CornerC="-110,-110,0", CornerD="-10,-110,0")
line_2 = Line(StartPoint="-10,-60,0", EndPoint="-110,-60,0")
curve_3 = Curve(_4point_surface)
point = Point("-60,-60")
point_2 = Point("-94,-60")
line_3 = Line(StartPoint=point, EndPoint="-60,-60,300")
rotate_axis = RotateAxis(Geometry=point_2, Angle=degrees("180"), Axis=line_3)  # -> Geometry, Transform
rotate_axis_2 = RotateAxis(Geometry=point_2, Angle=degrees("60"), Axis=line_3)  # -> Geometry, Transform
rotate_axis_3 = RotateAxis(Geometry=point_2, Angle=degrees("240"), Axis=line_3)  # -> Geometry, Transform
rotate_axis_4 = RotateAxis(Geometry=point_2, Angle=degrees("120"), Axis=line_3)  # -> Geometry, Transform
rotate_axis_5 = RotateAxis(Geometry=point_2, Angle=degrees("300"), Axis=line_3)  # -> Geometry, Transform
move = Move(Geometry=point_2, Motion="0,0,300")  # -> Geometry, Transform
move_2 = Move(Geometry=rotate_axis_2.Geometry, Motion="0,0,300")  # -> Geometry, Transform
move_3 = Move(Geometry=rotate_axis_4.Geometry, Motion="0,0,300")  # -> Geometry, Transform
move_4 = Move(Geometry=rotate_axis.Geometry, Motion="0,0,300")  # -> Geometry, Transform
move_5 = Move(Geometry=rotate_axis_3.Geometry, Motion="0,0,300")  # -> Geometry, Transform
move_6 = Move(Geometry=rotate_axis_5.Geometry, Motion="0,0,300")  # -> Geometry, Transform
line_4 = Line(StartPoint=point_2, EndPoint=move.Geometry)
line_5 = Line(StartPoint=rotate_axis_2.Geometry, EndPoint=move_2.Geometry)
line_6 = Line(StartPoint=rotate_axis_4.Geometry, EndPoint=move_3.Geometry)
line_7 = Line(StartPoint=rotate_axis_3.Geometry, EndPoint=move_5.Geometry)
line_8 = Line(StartPoint=rotate_axis.Geometry, EndPoint=move_4.Geometry)
line_9 = Line(StartPoint=rotate_axis_5.Geometry, EndPoint=move_6.Geometry)
point_3 = Point("-60,-60")
unit_y = UnitY(Factor=number_slider_4)
line_10 = Line(StartPoint=point_3, EndPoint="-60,-60,300")
move_7 = Move(Geometry=point_3, Motion=unit_y)  # -> Geometry, Transform
subtraction = Subtraction(A="-60", B=number_slider_3)
vector_2pt = Vector2Pt(PointA=point_3, PointB=move_7.Geometry, Unitize=False)  # -> Vector, Length
construct_point_2 = ConstructPoint(XCoordinate=subtraction, YCoordinate="-60", ZCoordinate=0)
rotate_axis_6 = RotateAxis(Geometry=construct_point_2, Angle=degrees("180"), Axis=line_3)  # -> Geometry, Transform
rotate_axis_7 = RotateAxis(Geometry=construct_point_2, Angle=degrees("120"), Axis=line_3)  # -> Geometry, Transform
rotate_axis_8 = RotateAxis(Geometry=construct_point_2, Angle=degrees("60"), Axis=line_3)  # -> Geometry, Transform
rotate_axis_9 = RotateAxis(Geometry=construct_point_2, Angle=degrees("240"), Axis=line_3)  # -> Geometry, Transform
rotate_axis_10 = RotateAxis(Geometry=construct_point_2, Angle=degrees("300"), Axis=line_3)  # -> Geometry, Transform
polyline = PolyLine(
    Vertices=[point_2, rotate_axis_2.Geometry, rotate_axis_4.Geometry, rotate_axis.Geometry, rotate_axis_6.Geometry, rotate_axis_7.Geometry, rotate_axis_8.Geometry, construct_point_2, rotate_axis_10.Geometry, rotate_axis_9.Geometry, rotate_axis_3.Geometry, rotate_axis_5.Geometry],
    Closed=True)
surface = Surface(polyline)
area = Area(Geometry=surface)  # -> Area, Centroid
rotate = Rotate(Vector=vector_2pt.Vector, Axis=line_10, Angle=degrees(number_slider))
panel_6 = Panel(area.Area)
move_8 = Move(Geometry=rotate_axis_8.Geometry, Motion="0,0,300")  # -> Geometry, Transform
move_9 = Move(Geometry=rotate_axis_7.Geometry, Motion="0,0,300")  # -> Geometry, Transform
move_10 = Move(Geometry=rotate_axis_6.Geometry, Motion="0,0,300")  # -> Geometry, Transform
move_11 = Move(Geometry=rotate_axis_9.Geometry, Motion="0,0,300")  # -> Geometry, Transform
move_12 = Move(Geometry=construct_point_2, Motion="0,0,300")  # -> Geometry, Transform
move_13 = Move(Geometry=rotate_axis_10.Geometry, Motion="0,0,300")  # -> Geometry, Transform
move_14 = Move(Geometry=move_8.Geometry, Motion=rotate)  # -> Geometry, Transform
move_15 = Move(Geometry=move_10.Geometry, Motion=rotate)  # -> Geometry, Transform
move_16 = Move(Geometry=move_12.Geometry, Motion=rotate)  # -> Geometry, Transform
move_17 = Move(Geometry=move_9.Geometry, Motion=rotate)  # -> Geometry, Transform
move_18 = Move(Geometry=move_11.Geometry, Motion=rotate)  # -> Geometry, Transform
move_19 = Move(Geometry=move_13.Geometry, Motion=rotate)  # -> Geometry, Transform
line_11 = Line(StartPoint=rotate_axis_8.Geometry, EndPoint=move_14.Geometry)
line_12 = Line(StartPoint=rotate_axis_6.Geometry, EndPoint=move_15.Geometry)
line_13 = Line(StartPoint=construct_point_2, EndPoint=move_16.Geometry)
line_14 = Line(StartPoint=rotate_axis_9.Geometry, EndPoint=move_18.Geometry)
line_15 = Line(StartPoint=rotate_axis_7.Geometry, EndPoint=move_17.Geometry)
line_16 = Line(StartPoint=rotate_axis_10.Geometry, EndPoint=move_19.Geometry)

polyline_2 = PolyLine(
    Vertices=[construct_point_2, rotate_axis_8.Geometry, rotate_axis_7.Geometry, rotate_axis_6.Geometry, rotate_axis_9.Geometry, rotate_axis_10.Geometry],
    Closed=True)
polyline_3 = PolyLine(
    Vertices=[point_2, rotate_axis_2.Geometry, rotate_axis_4.Geometry, rotate_axis.Geometry, rotate_axis_3.Geometry, rotate_axis_5.Geometry],
    Closed=True)
area_2 = Area(Geometry=polyline_3)  # -> Area, Centroid
area_3 = Area(Geometry=polyline_2)  # -> Area, Centroid
subtraction_2 = Subtraction(A=area_2.Area, B=area_3.Area)
panel_7 = Panel(subtraction_2)

# ----
# Surface Area
polyline_4 = PolyLine(
    Vertices=[rotate_axis.Geometry, rotate_axis_4.Geometry, rotate_axis_2.Geometry, point_2, rotate_axis_5.Geometry, rotate_axis_3.Geometry],
    Closed=False)
polyline_5 = PolyLine(
    Vertices=[rotate_axis_9.Geometry, rotate_axis_10.Geometry, construct_point_2, rotate_axis_8.Geometry, rotate_axis_7.Geometry, rotate_axis_6.Geometry],
    Closed=False)

# ----
# Form above windcatcher
unit_z = UnitZ(Factor=number_slider_5)
unit_z_2 = UnitZ(Factor=number_slider_6)
unit_z_3 = UnitZ(Factor=number_slider_6)
unit_z_4 = UnitZ(Factor=number_slider_5)
move_20 = Move(Geometry=rotate_axis_6.Geometry, Motion=unit_z_2)  # -> Geometry, Transform
move_21 = Move(Geometry=rotate_axis_9.Geometry, Motion=unit_z_3)  # -> Geometry, Transform
move_22 = Move(Geometry=rotate_axis_3.Geometry, Motion=unit_z)  # -> Geometry, Transform
move_23 = Move(Geometry=rotate_axis.Geometry, Motion=unit_z_4)  # -> Geometry, Transform
polyline_6 = PolyLine(Vertices=[move_22.Geometry, move_23.Geometry, move_20.Geometry, move_21.Geometry], Closed=True)

# ----
# Form below windcatcher
polyline_7 = PolyLine(Vertices=[rotate_axis_3.Geometry, rotate_axis.Geometry, rotate_axis_6.Geometry, rotate_axis_9.Geometry], Closed=True)
polyline_8 = PolyLine(Vertices=[move_22.Geometry, move_23.Geometry, move_20.Geometry, move_21.Geometry], Closed=True)
loft = Loft(
    Curves=[polyline_7, polyline_8],
    Options={Adjust=False, Closed=False, LoftEnds=0, LoftSimp=0, LoftType=0, Rebuild=10, Refit=0.01})
cap_holes_ex = CapHolesEx(Brep=loft)  # -> Brep, Caps, Solid
volume = Volume(Geometry=cap_holes_ex.Brep)  # -> Volume, Centroid
panel_8 = Panel(volume.Volume)

# ----
# Check results
# Average Height
addition = Addition(A=panel, B=panel_8)
division = Division(A=addition, B=panel_7)
panel_9 = Panel(division)

unit_z_5 = UnitZ(Factor=panel_9)
unit_z_6 = UnitZ(Factor=panel_9)
move_24 = Move(Geometry=line_2, Motion=unit_z_5)  # -> Geometry, Transform
move_25 = Move(Geometry=_4point_surface, Motion=unit_z_6)  # -> Geometry, Transform
rotate_axis_11 = RotateAxis(Geometry=move_25.Geometry, Angle=degrees(number_slider_2), Axis=move_24.Geometry)  # -> Geometry, Transform
rotate_axis_12 = RotateAxis(Geometry=rotate_axis_11.Geometry, Angle=degrees(number_slider), Axis=line_3)  # -> Geometry, Transform
line_plane = LinePlane(Line=line_6, Plane=rotate_axis_12.Geometry)  # -> Point, ParamL, ParamP
line_plane_2 = LinePlane(Line=line_4, Plane=rotate_axis_12.Geometry)  # -> Point, ParamL, ParamP
line_plane_3 = LinePlane(Line=line_5, Plane=rotate_axis_12.Geometry)  # -> Point, ParamL, ParamP
line_plane_4 = LinePlane(Line=line_8, Plane=rotate_axis_12.Geometry)  # -> Point, ParamL, ParamP
line_plane_5 = LinePlane(Line=line_7, Plane=rotate_axis_12.Geometry)  # -> Point, ParamL, ParamP
line_plane_6 = LinePlane(Line=line_9, Plane=rotate_axis_12.Geometry)  # -> Point, ParamL, ParamP
line_plane_7 = LinePlane(Line=line_15, Plane=rotate_axis_12.Geometry)  # -> Point, ParamL, ParamP
line_plane_8 = LinePlane(Line=line_14, Plane=rotate_axis_12.Geometry)  # -> Point, ParamL, ParamP
line_plane_9 = LinePlane(Line=line_13, Plane=rotate_axis_12.Geometry)  # -> Point, ParamL, ParamP
line_plane_10 = LinePlane(Line=line_11, Plane=rotate_axis_12.Geometry)  # -> Point, ParamL, ParamP
line_plane_11 = LinePlane(Line=line_12, Plane=rotate_axis_12.Geometry)  # -> Point, ParamL, ParamP
line_plane_12 = LinePlane(Line=line_16, Plane=rotate_axis_12.Geometry)  # -> Point, ParamL, ParamP
polyline_9 = PolyLine(
    Vertices=[line_plane_2.Point, line_plane_3.Point, line_plane.Point, line_plane_4.Point, line_plane_11.Point, line_plane_7.Point, line_plane_10.Point, line_plane_9.Point, line_plane_12.Point, line_plane_8.Point, line_plane_5.Point, line_plane_6.Point],
    Closed=True)
surface_2 = Surface(polyline_9)
loft_2 = Loft(
    Curves=[surface, surface_2],
    Options={Adjust=False, Closed=False, LoftEnds=0, LoftSimp=0, LoftType=0, Rebuild=10, Refit=0.01})
cap_holes_ex_2 = CapHolesEx(Brep=loft_2)  # -> Brep, Caps, Solid

# ----
# Attempt for Steppted Flat Roof
polyline_10 = PolyLine(Vertices=[line_plane.Point, line_plane_3.Point, line_plane_10.Point, line_plane_7.Point], Closed=True)
# Control Panel
polygon_center = PolygonCenter(Polyline=polyline_10)  # -> CenterV, CenterE, CenterA
point_4 = Point(polygon_center.CenterA)

polyline_11 = PolyLine(Vertices=[line_plane_5.Point, line_plane_4.Point, line_plane_11.Point, line_plane_8.Point], Closed=True)
loft_3 = Loft(
    Curves=[polyline_6, polyline_11],
    Options={Adjust=False, Closed=False, LoftEnds=0, LoftSimp=0, LoftType=0, Rebuild=10, Refit=0.01})
cap_holes_ex_3 = CapHolesEx(Brep=loft_3)  # -> Brep, Caps, Solid

volume_2 = Volume(Geometry=[cap_holes_ex_2.Brep, cap_holes_ex_3.Brep])  # -> Volume, Centroid
panel_10 = Panel(volume_2.Volume)

mass_addition = MassAddition(Input=panel_10)  # -> Result, PartialResults

# ----
# Actual Volume
actual_volume = Panel(mass_addition.Result)

polyline_12 = PolyLine(Vertices=[line_plane_5.Point, line_plane_4.Point, move_23.Geometry, move_22.Geometry], Closed=True)
polyline_13 = PolyLine(
    Vertices=[line_plane_4.Point, line_plane.Point, line_plane_3.Point, line_plane_2.Point, line_plane_6.Point, line_plane_5.Point, line_plane_8.Point, line_plane_12.Point, line_plane_9.Point, line_plane_10.Point, line_plane_7.Point, line_plane_11.Point],
    Closed=True)
polyline_14 = PolyLine(Vertices=[rotate_axis_3.Geometry, rotate_axis_9.Geometry, move_21.Geometry, move_22.Geometry], Closed=True)
polyline_15 = PolyLine(Vertices=[line_plane_8.Point, line_plane_11.Point, move_20.Geometry, move_21.Geometry], Closed=True)
polyline_16 = PolyLine(
    Vertices=[line_plane_4.Point, line_plane.Point, line_plane_3.Point, line_plane_2.Point, line_plane_6.Point, line_plane_5.Point],
    Closed=False)
polyline_17 = PolyLine(
    Vertices=[line_plane_8.Point, line_plane_12.Point, line_plane_9.Point, line_plane_10.Point, line_plane_7.Point, line_plane_11.Point],
    Closed=False)
loft_4 = Loft(
    Curves=[polyline_4, polyline_16],
    Options={Adjust=False, Closed=False, LoftEnds=0, LoftSimp=0, LoftType=0, Rebuild=10, Refit=0.01})
area_4 = Area(Geometry=polyline_11)  # -> Area, Centroid
area_5 = Area(Geometry=polyline_6)  # -> Area, Centroid
area_6 = Area(Geometry=polyline_12)  # -> Area, Centroid
area_7 = Area(Geometry=polyline_15)  # -> Area, Centroid
area_8 = Area(Geometry=polyline_14)  # -> Area, Centroid
area_9 = Area(Geometry=polyline_13)  # -> Area, Centroid
loft_5 = Loft(
    Curves=[polyline_17, polyline_5],
    Options={Adjust=False, Closed=False, LoftEnds=0, LoftSimp=0, LoftType=0, Rebuild=10, Refit=0.01})
area_10 = Area(Geometry=loft_4)  # -> Area, Centroid
area_11 = Area(Geometry=loft_5)  # -> Area, Centroid
panel_11 = Panel(area_8.Area)
panel_12 = Panel(area_5.Area)
panel_13 = Panel(area_4.Area)
panel_14 = Panel(area_6.Area)
panel_15 = Panel(area_9.Area)
panel_16 = Panel(area_7.Area)
panel_17 = Panel(area_10.Area)
panel_18 = Panel(area_11.Area)
multiplication = Multiplication(A=panel_11, B="2")
panel_19 = Panel(multiplication)
mass_addition_2 = MassAddition(Input=[panel_12, panel_13, panel_14, panel_16, panel_15, panel_19, panel_17, panel_18])  # -> Result, PartialResults
panel_20 = Panel(mass_addition_2.Result)

# ----
# Compactness
division_2 = Division(A=panel_20, B=actual_volume)
compactness = Panel(division_2)

brep = Brep([cap_holes_ex_2.Brep, cap_holes_ex_3.Brep])
mass2zone_2 = Honeybee_Masses2Zones(zoneMasses=flatten(brep), maxRoofAngle="60", createHBZones=Toggle(True))  # -> out, HBZones; plug-in component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
solveadjc = Honeybee_SolveAdjacencies(HBZones=flatten(mass2zone_2.HBZones), removeCurrentAdjc=False, findAdjc=Toggle(True))  # -> out, HBZonesWADJ; plug-in component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

# ----
# Galzing
_4point_surface_2 = _4PointSurface(CornerA=construct_point_2, CornerB=line_plane_9.Point, CornerC=line_plane_12.Point, CornerD=rotate_axis_10.Geometry)
_4point_surface_3 = _4PointSurface(CornerA=rotate_axis_8.Geometry, CornerB=construct_point_2, CornerC=line_plane_9.Point, CornerD=line_plane_10.Point)
_4point_surface_4 = _4PointSurface(CornerA=rotate_axis_6.Geometry, CornerB=rotate_axis_7.Geometry, CornerC=line_plane_7.Point, CornerD=line_plane_11.Point)
_4point_surface_5 = _4PointSurface(CornerA=move_20.Geometry, CornerB=move_21.Geometry, CornerC=line_plane_8.Point, CornerD=line_plane_11.Point)
_4point_surface_6 = _4PointSurface(CornerA=rotate_axis_7.Geometry, CornerB=rotate_axis_8.Geometry, CornerC=line_plane_10.Point, CornerD=line_plane_7.Point)
_4point_surface_7 = _4PointSurface(CornerA=rotate_axis_10.Geometry, CornerB=rotate_axis_9.Geometry, CornerC=line_plane_8.Point, CornerD=line_plane_12.Point)
rectangle_2 = Rectangle(_4point_surface_3)
rectangle_3 = Rectangle(_4point_surface_2)
rectangle_4 = Rectangle(_4point_surface_6)
rectangle_5 = Rectangle(_4point_surface_4)
rectangle_6 = Rectangle(_4point_surface_5)
rectangle_7 = Rectangle(_4point_surface_7)
deconstruct_plane_2 = DeconstructPlane(Plane=rectangle_3)  # -> Origin, XAxis, YAxis, ZAxis
deconstruct_plane_3 = DeconstructPlane(Plane=rectangle_2)  # -> Origin, XAxis, YAxis, ZAxis
deconstruct_plane_4 = DeconstructPlane(Plane=rectangle_4)  # -> Origin, XAxis, YAxis, ZAxis
deconstruct_plane_5 = DeconstructPlane(Plane=rectangle_5)  # -> Origin, XAxis, YAxis, ZAxis
deconstruct_plane_6 = DeconstructPlane(Plane=rectangle_6)  # -> Origin, XAxis, YAxis, ZAxis
deconstruct_plane_7 = DeconstructPlane(Plane=rectangle_7)  # -> Origin, XAxis, YAxis, ZAxis
scale = Scale(Geometry=_4point_surface_2, Center=deconstruct_plane_2.Origin, Factor=Slider(0.9, range=0..1))  # -> Geometry, Transform
scale_2 = Scale(Geometry=_4point_surface_3, Center=deconstruct_plane_3.Origin, Factor=Slider(0.9, range=0..1))  # -> Geometry, Transform
scale_3 = Scale(Geometry=_4point_surface_6, Center=deconstruct_plane_4.Origin, Factor=Slider(0.9, range=0..1))  # -> Geometry, Transform
scale_4 = Scale(Geometry=_4point_surface_4, Center=deconstruct_plane_5.Origin, Factor=Slider(0.9, range=0..1))  # -> Geometry, Transform
scale_5 = Scale(Geometry=_4point_surface_5, Center=deconstruct_plane_6.Origin, Factor=Slider(0.9, range=0..1))  # -> Geometry, Transform
scale_6 = Scale(Geometry=_4point_surface_7, Center=deconstruct_plane_7.Origin, Factor=Slider(0.9, range=0..1))  # -> Geometry, Transform
addhbglz = Honeybee_addHBGlz(
    HBObj=solveadjc.HBZonesWADJ,
    childSurfaces=flatten([scale_6.Geometry, scale.Geometry, scale_2.Geometry, scale_3.Geometry, scale_4.Geometry, scale_5.Geometry]),
    EPConstructions=epconstruction)  # -> HBObjWGLZ; plug-in component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

# ----
# Customise Construction
setepzonecnstr = Honeybee_SetEPZoneConstruction(HBZones=flatten(addhbglz), wallEPConstruction=epconstruction_2, roofEPConstruction=epconstruction_2)  # -> simplify(modifiedHBZones); plug-in component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

# ----
# Thresholds
panel_21 = Panel("26")
setepzonethresholds = Honeybee_SetEnergyPlusZoneThresholds(HBZones=setepzonecnstr, coolingSetPt=panel_21, heatingSetPt="20", daylightIllumSetPt="300")  # -> out, HBZones; plug-in component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

# ----
# Shading, Zone Loads and Air Flow
# NOT ADDED YET
setepnatvent = Honeybee_SetEPAirFlow(HBZones=flatten(setepzonethresholds.HBZones))  # -> readMe, simplify(HBZones); plug-in component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
setepzoneloads = Honeybee_SetEnergyPlusZoneLoads(HBZones=setepnatvent.HBZones, lightingDensityPerArea="5.9")  # -> loads, HBZones; plug-in component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
hb_epcontextsrf = HoneybeeEPContextSurfaces()  # -> HBContext; inputs shdSurfaces: list of Brep, justBoundingBox: Boolean
# ---------- hb_epcontextsrf: Python ----------
"""
prepare shading/context geometries

    Args:
        northVectorOrRotation: A vector that shows North or a number that shows
                               the rotation of the North from the Y axis
        bldgMasses: List of closed Breps as thermal zones.
    Returns:
        report: ...
        thermalZones: Thermal zone's geometries for visualiza
"""

ghenv.Component.Name = 'Honeybee EP context Surfaces'
ghenv.Component.NickName = 'HB_EPContextSrf'
ghenv.Component.Message = 'VER 0.0.66\nJUL_07_2020'
ghenv.Component.IconDisplayMode = ghenv.Component.IconDisplayMode.application
ghenv.Component.Category = "HB-Legacy"
ghenv.Component.SubCategory = "10 | Energy | Energy"
#compatibleHBVersion = VER 0.0.57\nNOV_04_2016
#compatibleLBVersion = VER 0.0.59\nFEB_01_2015
ghenv.Component.AdditionalHelpFromDocStrings = "2"

import rhinoscriptsyntax as rs
import Rhino as rc
import scriptcontext as sc
import os
import System
import Grasshopper.Kernel as gh
import uuid

tolerance = sc.doc.ModelAbsoluteTolerance
import math


def main(shdSurfaces, EPTransSchedule, meshingSettings, justBoundingBox):
    
    # import the classes
    if sc.sticky.has_key('honeybee_release'):

        try:
            if not sc.sticky['honeybee_release'].isCompatible(ghenv.Component): return -1
            if sc.sticky['honeybee_release'].isInputMissing(ghenv.Component): return -1
        except:
            warning = "You need a newer version of Honeybee to use this compoent." + \
            " Use updateHoneybee component to update userObjects.\n" + \
            "If you have already updated userObjects drag Honeybee_Honeybee component " + \
            "into canvas and try again."
            w = gh.GH_RuntimeMessageLevel.Warning
            ghenv.Component.AddRuntimeMessage(w, warning)
            return -1
        
        # don't customize this part
        hb_EPSrf = sc.sticky["honeybee_EPSurface"]
        hb_EPSHDSurface = sc.sticky["honeybee_EPShdSurface"]
        hb_RADMaterialAUX = sc.sticky["honeybee_RADMaterialAUX"]
        hb_EPObjectsAux = sc.sticky["honeybee_EPObjectsAUX"]()
        HBScheduleList = sc.sticky["honeybee_ScheduleLib"].keys()

        ########################################################################
        #----------------------------------------------------------------------#
        shdBreps = []
        # create bounding box of shading geometries
        if justBoundingBox:
            for brep in shdSurfaces:
                if brep.Faces.Count>1 or not brep.Faces[0].IsPlanar(sc.doc.ModelAbsoluteTolerance):
                    shdBreps.append(brep.GetBoundingBox(True).ToBrep())
                else:
                    shdBreps.append(brep)
        else:
            shdBreps = shdSurfaces
        
        shadingClasses = []
        shadingMeshPreview = []
        
        if meshingSettings == None:
            mp = rc.Geometry.MeshingParameters.Minimal
            mp.SimplePlanes = True
        else:
            mp = meshingSettings
        
        def getRadMaterialName(radMaterial):
            nameStr = radMaterial.split(" ")[2]
            name =  nameStr.split("\n")[0]
            return name
        
        for brepCount, brep in enumerate(shdBreps):
            if brep != None:
                isPlanar = True
                # check planarity
                for face in brep.Faces:
                    if not face.IsPlanar(tolerance):
                        isPlanar = False
                        break
                
                shadingBreps = []
                if not isPlanar:
                    meshArray = rc.Geometry.Mesh.CreateFromBrep(brep, mp)
                    for mesh in meshArray:
                        for meshFace in range(mesh.Faces.Count):
                            vertices = list(mesh.Faces.GetFaceVertices(meshFace))[1:]
                            vertices = vertices + [sc.doc.ModelAbsoluteTolerance]
                            # create the brep from mesh
                            shdBrep = rc.Geometry.Brep.CreateFromCornerPoints(*vertices)
                            shadingBreps.append(shdBrep)
                else:
                    for face in brep.Faces:
                        shadingBreps.append(face.DuplicateFace(False))
                
                for faceCount, shdBrep in enumerate(shadingBreps):
                        thisShading = hb_EPSHDSurface(shdBrep, 1000*brepCount + faceCount, 'shdSrf_' + `brepCount` + '_' + `faceCount` + "_" + str(uuid.uuid4()))
                        
                        # add transmittance schedule if any
                        if EPTransSchedule!=None:
                            schedule= EPTransSchedule.upper()
                            if schedule!=None and not schedule.lower().endswith(".csv") and schedule not in HBScheduleList:
                                msg = "Cannot find " + schedule + " in Honeybee schedule library."
                                print msg
                                ghenv.Component.AddRuntimeMessage(gh.GH_RuntimeMessageLevel.Warning, msg)
                                return -1
                            elif schedule!=None and schedule.lower().endswith(".csv"):
                                # check if csv file is existed
                                if not os.path.isfile(schedule):
                                    msg = "Cannot find the shchedule file: " + schedule
                                    print msg
                                    ghenv.Component.AddRuntimeMessage(gh.GH_RuntimeMessageLevel.Warning, msg)
                                    return -1
                            
                            thisShading.TransmittanceSCH = schedule
                        
                        # add the Rad Material if any
                        if RADMaterial!=None:
                            # if it is just the name of the material make sure it is already defined
                            if len(RADMaterial.split(" ")) == 1:
                                # if the material is not in the library add it to the library
                                if not hb_RADMaterialAUX.isMatrialExistInLibrary(RADMaterial):
                                    warningMsg = "Can't find " + RADMaterial + " in RAD Material Library.\n" + \
                                                "Add the material to the library and try again."
                                    ghenv.Component.AddRuntimeMessage(gh.GH_RuntimeMessageLevel.Warning, warningMsg)
                                    return
                                
                                try:
                                    thisShading.setRADMaterial(RADMaterial)
                                except Exception, e:
                                    print e
                                    warningMsg = "You are using an old version of Honeybee_Honeybee! Update your files and try again."
                                    print warningMsg
                                    ghenv.Component.AddRuntimeMessage(gh.GH_RuntimeMessageLevel.Warning, warningMsg)
                                    return
                                
                                addedToLib = True
                            else:
                                
                                # try to add the material to the library
                                addedToLib, thisShading.RadMaterial = hb_RADMaterialAUX.analyseRadMaterials(RADMaterial, True)
                                
                            if addedToLib==False:
                                warningMsg = "Failed to add " + RADMaterial + " to the Library."
                                ghenv.Component.AddRuntimeMessage(gh.GH_RuntimeMessageLevel.Warning, warningMsg)
                                return
                        
                        # add shading to the list
                        shadingClasses.append(thisShading)
                
        # add to the hive
        hb_hive = sc.sticky["honeybee_Hive"]()
        HBContext  = hb_hive.addToHoneybeeHive(shadingClasses, ghenv.Component)
        return HBContext
        ################################################################################################
    else:
        print "You should first let Honeybee to fly..."
        w = gh.GH_RuntimeMessageLevel.Warning
        ghenv.Component.AddRuntimeMessage(w, "You should first let Honeybee to fly...")
        return -1
        

if _shdSurfaces and _shdSurfaces[0]!=None:
    # add cleaning function
    result= main(_shdSurfaces, EPTransSchedule_, meshingSettings_, justBoundingBox_)
    
    if result != -1: HBContext = result
# ---------- end hb_epcontextsrf ----------

# ----
# Display & U-Value
honeybee_surface_attribute_list = Honeybee_SurfaceAttributeList({"Name": "name", "Radiance Material": "RadMaterial", "EnergyPlus Construction": "EPConstruction", "Surface Type": "type", "Boundary Condition": "BC", "BC Object": "BCObject", "Sun Exposure": "sunExposure", "Wind Exposure": "windExposure", "Has Child Surface": "hasChild", "Is Child Surface": "isChild", "Is Planar": "isPlanar", "Srf Type Set By User": "srfTypeByUser", "Boundary Condition Set By User": "srfBCByUser", "Shade Material Name": "shadeMaterialName", "Shading Control Name": "shadingControlName", "Shcading Schedule Name": "shadingSchName"}, selected="EnergyPlus Construction")
decomposebytype = Honeybee_DecomposeBasedOnType(HBZone=setepzonethresholds.HBZones)  # -> walls, interiorWalls, airWalls, windows, interiorWindows, skylights, roofs, ceilings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; plug-in component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
window_wall_toggle = BooleanToggle(True)
labelsurfaces = Honeybee_LabelZoneSurfaces(HBObjects=flatten(setepzonethresholds.HBZones), attribute=honeybee_surface_attribute_list, windows=window_wall_toggle)  # -> surfaceTxtLabels, labelBasePts, brepTxtLabels, surfaceWireFrames; plug-in component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
custom_preview = CustomPreview(Geometry=decomposebytype.walls, Material=ColourSwatch(SwatchColor=RGB(255, 248, 176)))
custom_preview_2 = CustomPreview(Geometry=decomposebytype.windows, Material=ColourSwatch(SwatchColor=RGBA(74, 225, 255, 132)))
custom_preview_3 = CustomPreview(Geometry=decomposebytype.roofs, Material=ColourSwatch(SwatchColor=RGB(255, 163, 140)))
custom_preview_4 = CustomPreview(Geometry=decomposebytype.groundFloors, Material=ColourSwatch(SwatchColor=RGB(8, 86, 255)))
decomposeepconstruction = Honeybee_DecomposeEPConstruction()  # -> materials, comments, UValue_SI, UValue_IP, RValue_SI, RValue_IP; plug-in component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
panel_22 = Panel(decomposeepconstruction.materials)

# ----
# Simulation
boolean_toggle = BooleanToggle(True)
epoutput = Honeybee_GenerateEPOutput(
    zoneEnergyUse=boolean_toggle,
    zoneGainsAndLosses=boolean_toggle,
    zoneComfortMetrics=boolean_toggle,
    surfaceTempAnalysis=boolean_toggle,
    surfaceEnergyAnalysis=boolean_toggle)  # -> out, flatten(simulationOutputs); plug-in component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
exporttoopenstudio = Honeybee_ExportToOpenStudio(
    epwWeatherFile="C:\Users\PewPe\Downloads\HotArid.epw",
    HBZones=flatten(setepzonethresholds.HBZones),
    HBContext=flatten(hb_epcontextsrf),
    simulationOutputs=flatten(epoutput.simulationOutputs),
    writeOSM=Toggle(True),
    runSimulation=Toggle(True))  # -> out, osmFileAddress, idfFileAddress, resultFileAddress, eioFileAddress, rddFileAddress, htmlReport, studyFolder, model; plug-in component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

# ----
# Read Results
readepresult = Honeybee_ReadEPResult(resultFileAddress=exporttoopenstudio.resultFileAddress)  # -> totalThermalLoad, thermalLoadBalance, cooling, heating, electricLight, electricEquip, port, port_2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; plug-in component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
readepsrfresult = Honeybee_ReadEPSurfaceResult(resultFileAddress=exporttoopenstudio.resultFileAddress)  # -> surfaceIndoorTemp, surfaceOutdoorTemp, surfaceEnergyFlow, opaqueEnergyFlow, glazEnergyFlow, port, port_2, port_3, port_4; plug-in component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

panel_23 = Panel(decomposeepconstruction.UValue_SI)

# ----
# Calculate Energy Loads
strnum = Ladybug_SeparateData(inputList=flatten(readepresult.totalSolarGain))  # -> numbers, strings; plug-in component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
strnum_2 = Ladybug_SeparateData(inputList=flatten(readepresult.heating))  # -> numbers, strings; plug-in component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
strnum_3 = Ladybug_SeparateData(inputList=flatten(readepresult.cooling))  # -> numbers, strings; plug-in component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
mass_addition_3 = MassAddition(Input=flatten(strnum.numbers))  # -> Result, PartialResults
mass_addition_4 = MassAddition(Input=flatten(strnum_3.numbers))  # -> Result, PartialResults
mass_addition_5 = MassAddition(Input=flatten(strnum_2.numbers))  # -> Result, PartialResults
cooling_load_kwh = Panel(mass_addition_4.Result)
panel_24 = Panel(mass_addition_3.Result)
heating_load_kwh = Panel(mass_addition_5.Result)
division_3 = Division(A=cooling_load_kwh, B=actual_volume)
division_4 = Division(A=heating_load_kwh, B=actual_volume)

# ----
# Cooling Load kWh/m³
cooling_load_kwh_m3 = Panel(division_3)

# ----
# Heating Load kWh/m³
heating_load_kwh_m3 = Panel(division_4)

python_2 = GhPythonScript(
    coolingLoad=cooling_load_kwh_m3,
    heatingLoad=heating_load_kwh_m3,
    actualVolume=actual_volume,
    compactness=compactness,
    height=panel_9,
    radius=number_slider_3,
    altitude=number_slider_2,
    azimuth=number_slider)  # -> out, a
# ---------- python_2: Python ----------
__author__ = "Desktop"
__version__ = "2020.10.28"

import rhinoscriptsyntax as rs
f = open('C:\Users\PewPe\OneDrive - NTNU\python_csv_from_para_model.txt', 'a')
string = coolingLoad + ',' + heatingLoad + ',' + actualVolume + ',' + compactness + ',' + height +',' + str(radius) + ',' + str(altitude) + ',' + str(azimuth) + '\n' 
f.write(string)  
f.close()
a = string
# ---------- end python_2 ----------
panel_25 = Panel(python_2.a)
rec = DataRecorder(panel_25, DataLimit=10000, RecordData=True)
panel_26 = Panel(rec)

# ----
# Construct Energy Balance Chart
energybalance = Honeybee_ConstructEnergyBalance(
    HBZones=flatten(setepzonethresholds.HBZones),
    cooling=readepresult.cooling,
    heating=readepresult.heating,
    electricLight=readepresult.electricLight,
    electricEquip=readepresult.electricEquip,
    peopleGains=readepresult.peopleGains,
    totalSolarGain=readepresult.totalSolarGain,
    infiltrationEnergy=readepresult.infiltrationEnergy,
    mechVentilationEnergy=readepresult.mechVentilationEnergy,
    natVentEnergy=readepresult.port_3,
    surfaceEnergyFlow=readepsrfresult.surfaceEnergyFlow)  # -> out, port, flrNormEnergyBal, flrNormBalWStorage, port_2, modelEnergyBalance, energyBalWithStorage; plug-in component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
selectandaveragedata = Ladybug_AverageData(annualHourlyData=energybalance.flrNormBalWStorage, totalOrAverage=Toggle(True))  # -> readMe, selHourlyData, totaledDaily, totaledMonthly, totMonthlyPerHour, totMonthlyMinPerHour, totMonthlyMaxPerHour; plug-in component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
gradientlibrary = Ladybug_GradientLibrary(gradIndex="19")  # -> customColors; plug-in component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
legendpar = Ladybug_LegendParameters(customColors=flatten(gradientlibrary))  # -> legendPar; plug-in component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
barchart = Ladybug_MonthlyBarChart(
    inputData=flatten(selectandaveragedata.totaledMonthly),
    stackValues=Toggle(True),
    altYAxisTitle="Energy Intensity",
    legendPar=legendpar)  # -> out, dataMesh, dataCurves, dataCrvColors, graphAxes, graphLabels, title, titleBasePt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; plug-in component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
